# Grasshopper definition 20221109_Wave Form Python_Animation_BR_0.1.ghx (Grasshopper 1.0.7)
# plug-ins: Heteroptera, Human

number_slider = Slider(0.9, range=0..1)  # disabled
number_slider_2 = Slider(2, range=1..4)  # disabled
number_slider_3 = Slider(0.25, range=0..1)  # disabled

# ----
# Contour Lines
number_slider_4 = Slider(2, range=1..4)
multiplication = Multiplication(A=number_slider_4, B=Slider(0.25, range=0..1))
rad = Radians(Degrees=Slider(15, range=0..100))
python = GhPythonScript(
    r=Slider(175, range=0..1000),
    t=multiplication,
    div=Slider(60, range=0..100),
    h=Slider(160, range=0..200),
    tilt=Slider(2, range=1..6),
    gap_z=Slider(0, range=0..10),
    bricks_angle=rad)  # -> out, up_crv, base_pts, base_crv, vec_xy_pl, wall, grid_pts, brick_pts; inputs div: Int32, gap_z: Int32
# ---------- python: Python ----------
__author__ = "jiang"
__version__ = "2022.11.03"

import rhinoscriptsyntax as rs
import Rhino.Geometry as rg
import Rhino
import math
import copy

length = 30
width = 15
height = 10

#make and reparameterize circle to crv
base_crv = rg.Circle.ToNurbsCurve(rg.Circle(rg.Point3d(0,0,0),r))
base_crv.Domain = rg.Interval(0,1)

# make the a point on circle as end point
id_pt = rg.Curve.ChangeClosedCurveSeam(base_crv,t)

#t value on circle
para = rg.Curve.DivideByCount(base_crv, div, True)

#base points for curv
base_pts = []
for p in para:
    base_pts.append(base_crv.PointAt(p))
    
#rotation direction
vec_xy_pl = rg.Vector3d(base_pts[0]-rg.Point3d(0,0,0))

# z_value of upper points
z_value=[]
for i in range(len(base_pts)):
    z_value.append(math.sin(((4*math.pi/len(base_pts))*i)+math.pi*0.5)*r/5)

#upper points for crv
up_pts = copy.deepcopy(base_pts)

for i, pt in enumerate(up_pts):
    tranMatrix = rg.Transform.Translation(rg.Vector3d(0, 0,z_value[i]+h))
    pt.Transform(tranMatrix)

for p, pt in enumerate(up_pts):
    pt.Transform(rg.Transform.Translation(vec_xy_pl/tilt))

#add end_pt to close the curve
end_pt= copy.copy(up_pts[0])
up_pts.append(end_pt)
up_crv = rg.Curve.CreateInterpolatedCurve(up_pts, 3,rg.CurveKnotStyle(3))


#crvs to wall brep
loft_crvs = [base_crv, up_crv]
wall = rg.Brep.CreateFromLoft(loft_crvs, rg.Point3d.Unset, rg.Point3d.Unset, rg.LoftType.Tight, False)


# from base_pts to pt_grid 
#a)difine layers
grid_length = base_pts[0].DistanceTo(up_pts[0])
grid_layer_cnt = int(math.ceil(grid_length/height))
#b)define move direction
grid_direction = rg.Vector3d(rg.Point3d(0,0,z_value[0]+h)-rg.Point3d(0,0,0))+(vec_xy_pl/tilt)
#c) move angle to xy_plane
grid_angle = rg.Vector3d.VectorAngle(grid_direction, vec_xy_pl)
grid_direction.Unitize()
#d) move distance of each pt
grid_unit = height/math.sin(grid_angle)+gap_z

grid_pts=[]
for h in range(grid_layer_cnt):
#    plane_pts = []
    for pt in base_pts:
        pt = copy.copy(pt)
        t = rg.Transform(rg.Transform.Translation(h*(grid_direction*grid_unit)))
        pt.Transform(t)
#        plane_pts.append(pt)
        grid_pts.append(pt)

#seclect brick pts
brick_pts = grid_pts[::2]
# ---------- end python ----------
brep = Brep(python.wall)
pt = Point(python.grid_pts)
pt_2 = Point(python.brick_pts)
crv = Curve(python.base_crv)
crv_2 = Curve(python.up_crv)
item = ListItem(List=pt_2, Index="6", Wrap=True)
item_2 = ListItem(List=pt_2, Index="36", Wrap=True)
vec2pt = Vector2Pt(PointA=item, PointB=item_2, Unitize=False)  # -> Vector, Length
unit = UnitVector(Vector=vec2pt.Vector)
series = Series(Start=0, Step=Slider(11, range=0..100), Count=Slider(1, range=0..100))
multiplication_2 = Multiplication(A=unit, B=series)
move = Move(Geometry=crv, Motion=multiplication_2)  # -> Geometry, Transform
dispatch = Dispatch(List=move.Geometry, DispatchPattern=[True, False])  # -> graft(ListA), graft(ListB)

panel = Panel("175")  # disabled
number_slider_5 = Slider(15, range=0..100)  # disabled
number_slider_6 = Slider(0, range=0..10)  # disabled
number_slider_7 = Slider(60, range=0..100)  # disabled
number_slider_8 = Slider(120, range=0..120)  # disabled
number_slider_9 = Slider(6, range=1..6)  # disabled
number_slider_10 = Slider(175, range=0..1000)  # disabled
multiplication_3 = Multiplication(A=number_slider_2, B=number_slider_3)  # disabled
rad_2 = Radians(Degrees=number_slider_5)  # disabled
number_slider_11 = Slider(30, range=0..100)  # disabled
number_slider_12 = Slider(15, range=0..100)  # disabled
number_slider_13 = Slider(10, range=0..10)  # disabled
python_2 = GhPythonScript(
    r=number_slider_10,
    t=multiplication_3,
    div=number_slider_7,
    h=number_slider_8,
    tilt=number_slider_9,
    gap_z=number_slider_6,
    bricks_angle=rad_2)  # -> out, up_crv, base_pts, base_crv, vec_xy_pl, wall, grid_pts, brick_pts; inputs div: Int32, gap_z: Int32; disabled
# ---------- python_2: Python ----------
__author__ = "jiang"
__version__ = "2022.11.03"

import rhinoscriptsyntax as rs
import Rhino.Geometry as rg
import Rhino
import math
import copy

length = 30
width = 15
height = 10

#make and reparameterize circle to crv
base_crv = rg.Circle.ToNurbsCurve(rg.Circle(rg.Point3d(0,0,0),r))
base_crv.Domain = rg.Interval(0,1)

# make the a point on circle as end point
id_pt = rg.Curve.ChangeClosedCurveSeam(base_crv,t)

#t value on circle
para = rg.Curve.DivideByCount(base_crv, div, True)

#base points for curv
base_pts = []
for p in para:
    base_pts.append(base_crv.PointAt(p))
    
#rotation direction
vec_xy_pl = rg.Vector3d(base_pts[0]-rg.Point3d(0,0,0))

# z_value of upper points
z_value=[]
for i in range(len(base_pts)):
    z_value.append(math.sin(((4*math.pi/len(base_pts))*i)+math.pi*1)*r/5)
#    z_value.append(math.sin(((4*math.pi/len(base_pts))*i)+math.pi*0.5)*r/5)

#upper points for crv
up_pts = copy.deepcopy(base_pts)

for i, pt in enumerate(up_pts):
    tranMatrix = rg.Transform.Translation(rg.Vector3d(0, 0,z_value[i]+h))
    pt.Transform(tranMatrix)

for p, pt in enumerate(up_pts):
    pt.Transform(rg.Transform.Translation(vec_xy_pl/tilt))

#add end_pt to close the curve
end_pt= copy.copy(up_pts[0])
up_pts.append(end_pt)
up_crv = rg.Curve.CreateInterpolatedCurve(up_pts, 3,rg.CurveKnotStyle(3))


#crvs to wall brep
loft_crvs = [base_crv, up_crv]
wall = rg.Brep.CreateFromLoft(loft_crvs, rg.Point3d.Unset, rg.Point3d.Unset, rg.LoftType.Tight, False)


# from base_pts to pt_grid 
#a)difine layers
#Alternative_grid_length = base_pts[0].DistanceTo(up_pts[0])
grid_length = 
grid_layer_cnt = int(math.ceil(grid_length/height))
#b)define move direction
grid_direction = rg.Vector3d(rg.Point3d(0,0,z_value[0]+h)-rg.Point3d(0,0,0))+(vec_xy_pl/tilt)
#c) move angle to xy_plane
grid_angle = rg.Vector3d.VectorAngle(grid_direction, vec_xy_pl)
grid_direction.Unitize()
#d) move distance of each pt
grid_unit = height/math.sin(grid_angle)+gap_z

grid_pts=[]
for h in range(grid_layer_cnt):
    plane_pts = []
    for pt in base_pts:
        pt = copy.copy(pt)
        t = rg.Transform(rg.Transform.Translation(h*(grid_direction*grid_unit)))
        pt.Transform(t)
        plane_pts.append(pt)
    grid_pts.append(plane_pts)

#seclect brick pts
brick_pts = []
for i , plane in enumerate( grid_pts):
    if i%2== 0:
        brick_pt = grid_pts[::2]
    else:
        brick_pt = grid_pts[1::2]
    brick_pts.append(brick_pt)
    
print type(brick_pts)
# ---------- end python_2 ----------
number_slider_14 = Slider(15, range=0..100)  # disabled
brep_2 = Brep(python_2.wall)  # disabled
python_3 = GhPythonScript(x=python_2.brick_pts)  # -> out, a; disabled
# ---------- python_3: Python ----------
__author__ = "jiang"
__version__ = "2022.11.08"

import rhinoscriptsyntax as rs

a= x
# ---------- end python_3 ----------
box = DomainBox(Base=PlaneXY(0, 0, 0), X=number_slider_12, Y=number_slider_11, Z=number_slider_13)  # disabled
Y = UnitY(Factor=1)
python_4 = GhPythonScript(x=python_3.a)  # -> out, a; disabled; same code as python_3
yz = YZPlane(Origin=Point(0, 0, 0))  # disabled
rad_3 = Radians(Degrees=number_slider_14)  # disabled
rot3d = Rotate3D(Geometry=brep, Angle=degrees(Slider(10, range=0..10)), Center=Point(0, 0, 0), Axis=Y)  # -> Geometry, Transform
pt_3 = Point(python_4.a)  # disabled
rotate = Rotate(Geometry=box, Angle=rad_3, Plane=yz)  # -> Geometry, Transform; disabled
rotate_2 = Rotate(Geometry=rotate.Geometry, Angle=1.570796327, Plane=PlaneXY(0, 0, 0))  # -> Geometry, Transform; disabled
previewlw = CustomPreviewLineweights(Geometry=dispatch.ListA, Shader=ColourSwatch(SwatchColor=RGB(0, 0, 0)), Thickness="1", Absolute=False)
division = Division(A="10", B="2")
divide = DivideCurve(Curve=dispatch.ListA, Count="36", Kinks=False)  # -> Points, Tangents, Parameters
dom = ConstructDomain(DomainStart=0, DomainEnd=Slider(0, range=0..36))
Z = UnitZ(Factor=division)
swatch = ColourSwatch(SwatchColor=RGB(255, 102, 102))
B = Base(PlaneXY(0, 0, 0))
subset = SubList(List=divide.Points, Domain=dom, Wrap=True)  # -> List, Index
move_2 = Move(Geometry=B, Motion=Z)  # -> Geometry, Transform
dots = DotDisplay(Point=subset.List, Colour=swatch, Size="3")
box_2 = CenterBox(Base=divide.Points, X=expr("x/2", "32.8"), Y=expr("x/2", "15.5"), Z=expr("x/2", "10"))
dom_2 = ConstructDomain(DomainStart=0, DomainEnd=Slider(0, range=0..36))
subset_2 = SubList(List=box_2, Domain=dom_2, Wrap=True)  # -> List, Index
preview = CustomPreview(Geometry=subset_2.List, Material=swatch)  # disabled
dom_3 = ConstructDomain(DomainStart=0, DomainEnd=Slider(36, range=0..36))
swatch_2 = ColourSwatch(SwatchColor=RGB(255, 102, 102))
dom_4 = ConstructDomain(DomainStart=0, DomainEnd=Slider(35, range=0..35))
dom_5 = ConstructDomain(DomainStart=0, DomainEnd=Slider(35, range=0..35))
dom_6 = ConstructDomain(DomainStart=0, DomainEnd=Slider(36, range=0..36))

# ----
# Animation Frames
number_slider_15 = Slider(512, range=0..512)  # disabled

panel_2 = Panel("512")  # disabled

# ----
# Animation
number_slider_16 = Slider(100, range=0..1000)  # disabled
panel_3 = Panel("1")  # disabled
panel_4 = Panel("512")  # disabled
dom_7 = ConstructDomain(DomainStart=panel_3, DomainEnd=panel_4)  # disabled
number_slider_17 = Slider(1, range=0..1)  # disabled
number_slider_18 = Slider(1599, range=0..2000)  # disabled
number_slider_19 = Slider(720, range=0..1000)  # disabled
range = Range(Domain=Domain(0, 1), Steps=dom_7)  # disabled
pt_4 = ConstructPoint(XCoordinate=0, YCoordinate=0, ZCoordinate=0)  # disabled
Z_2 = UnitZ(Factor=number_slider_16)  # disabled
item_3 = ListItem(List=range, Index=number_slider_15, Wrap=True)  # disabled
move_3 = Move(Geometry=pt_4, Motion=Z_2)  # -> Geometry, Transform; disabled
cir = Circle(Plane=pt_4, Radius=number_slider_18)  # disabled
Z_3 = UnitZ(Factor=number_slider_19)  # disabled
panel_5 = Panel("90")  # disabled
rotate_3 = Rotate(Geometry=cir, Angle=degrees(panel_5), Plane=PlaneXY(0, 0, 0))  # -> Geometry, Transform; disabled
move_4 = Move(Geometry=rotate_3.Geometry, Motion=Z_3)  # -> Geometry, Transform; disabled
number_slider_20 = Slider(100, range=0..100)  # disabled
toggle = BooleanToggle(True)  # disabled
eval = EvaluateCurve(Curve=reparameterize(move_4.Geometry), Parameter=item_3)  # -> Point, Tangent, Angle; disabled
camera = CameraCrane(Location=eval.Point, Target=move_3.Geometry, Lense=number_slider_20, Perspective=number_slider_17, Refresh=toggle)  # -> Camera, Target, Lens, Up, HorizontalViewAngle, VerticalViewAngle, ScreenRatio, Frame; disabled

panel_6 = Panel(item_3)  # disabled

# ----
# Divide circles with different distence.
number_slider_21 = Slider(36, range=0..100)
range_2 = Range(Domain=Domain(0, 1), Steps=number_slider_21)
graph = GraphMapper(
    range_2,
    x0=0,
    x1=1,
    y0=0,
    y1=1,
    container_name="Sine",
    Equation_px=[0.007785962895, 0.2544272542],
    Equation_py=[0.4870889783, 1])
shift = ShiftList(List=graph, Shift="-1", Wrap=invert(True))
ma = MassAddition(Input=shift)  # -> Result, PartialResults
bnd = Bounds(Numbers=ma.PartialResults)
remap = RemapNumbers(Value=ma.PartialResults, Source=bnd, Target=Domain(0, 1))  # -> Mapped, Clipped
eval_2 = EvaluateLength(Curve=dispatch.ListA, Length=remap.Mapped, Normalized=True)  # -> simplify(Point), Tangent, Parameter
shatter = Shatter(Curve=dispatch.ListA, Parameters=eval_2.Parameter)
cull_i = CullIndex(List=eval_2.Point, Indices="35", Wrap=True)
curvepoint = PointOnCurve(shatter, parameter=0.5)
pl = PlaneNormal(Origin=cull_i, ZAxis=Vector(0, 0, 1))
move_5 = Move(Geometry=curvepoint, Motion=Vector(0, 0, 10))  # -> simplify(Geometry), Transform

subset_3 = SubList(List=eval_2.Point, Domain=dom_3, Wrap=True)  # -> List, Index

# ---- group: First Layer
orient = Orient(Geometry=move_2.Geometry, Source=B, Target=pl)  # -> Geometry, Transform

# ---- group: Second Layer
orient_2 = Orient(Geometry=move_2.Geometry, Source=B, Target=move_5.Geometry)  # -> Geometry, Transform

# ----
dots_2 = DotDisplay(Point=subset_3.List, Colour=swatch_2, Size=Slider(3, range=0..10))

# ----
# Make a Brick
panel_7 = Panel("10")
box_3 = CenterBox(Base=orient.Geometry, X=expr("x/2", "32.8"), Y=expr("x/2", "15.5"), Z=expr("x/2", panel_7))

merge = Merge(Data1=orient.Geometry, Data2=orient_2.Geometry)  # -> flatten(Result)
colom = CollisionOneMany(Collider=box_3, Obstacles=brep)  # -> Collision, Index
cull = CullPattern(List=merge, CullPattern=colom.Collision)

box_4 = CenterBox(Base=orient_2.Geometry, X=expr("x/2", "32.8"), Y=expr("x/2", "15.5"), Z=expr("x/2", "10"))
box_5 = CenterBox(Base=orient.Geometry, X=expr("x/2", "32.8"), Y=expr("x/2", "15.5"), Z=expr("x/2", "10"))
subset_4 = SubList(List=box_4, Domain=dom_4, Wrap=True)  # -> List, Index
subset_5 = SubList(List=box_4, Domain=dom_5, Wrap=True)  # -> List, Index
subset_6 = SubList(List=box_5, Domain=dom_6, Wrap=True)  # -> List, Index
preview_2 = CustomPreview(Geometry=subset_6.List, Material=swatch_2)
debrep = DeconstructBrep(Brep=subset_4.List)  # -> Faces, Edges, Vertices
preview_3 = CustomPreview(Geometry=box_3, Material=ColourSwatch(SwatchColor=RGB(255, 171, 171)))
preview_4 = CustomPreview(Geometry=subset_5.List, Material=swatch_2)
item_4 = ListItem(List=debrep.Faces, Index=Slider(4, range=0..5), Wrap=True)
edges = BrepEdges(Brep=item_4)  # -> Naked, Interior, NonManifold
wires = BrepWireframe(Brep=item_4, Density=-1)
crv_3 = Curve(edges.Naked)
previewlw_2 = CustomPreviewLineweights(Geometry=wires, Shader=swatch_2, Thickness=Slider(2, range=0..10), Absolute=False)

# ----
# Make the bottom of the brick lamp flat
number_slider_22 = Slider(10, range=0..10)  # disabled
Y_2 = UnitY(Factor=1)  # disabled
rot3d_2 = Rotate3D(Geometry=cull, Angle=degrees(number_slider_22), Center=Point(0, 0, 0), Axis=Y_2)  # -> Geometry, Transform; disabled
number_slider_23 = Slider(27, range=0..100)  # disabled
flatten = FlattenTree(Tree=rot3d_2.Geometry, Path="{0}")  # disabled
series_2 = Series(Start=0, Step=1, Count=panel_2)  # disabled
swatch_3 = ColourSwatch(SwatchColor=RGB(255, 255, 255))  # disabled

deplane = DeconstructPlane(Plane=rot3d_2.Geometry)  # -> Origin, XAxis, YAxis, ZAxis; disabled

pdecon = Deconstruct(Point=deplane.Origin)  # -> XComponent, YComponent, ZComponent; disabled
flatten_2 = FlattenTree(Tree=pdecon.ZComponent, Path="{0}")  # disabled
sort = SortList(Keys=flatten_2, ValuesA=flatten)  # -> Keys, ValuesA; disabled
larger = LargerThan(FirstNumber=sort.Keys, SecondNumber=number_slider_23)  # -> LargerThan, OrEqualTo; disabled
dispatch_2 = Dispatch(List=sort.ValuesA, DispatchPattern=larger.LargerThan)  # -> ListA, ListB; disabled

# ----
# Bake these Planes
geo = Geometry(dispatch_2.ListA)  # disabled

lng = ListLength(List=geo)  # disabled
dom_8 = ConstructDomain(DomainStart=0, DomainEnd=lng)  # disabled
panel_8 = Panel(lng)  # disabled
subset_7 = SubList(List=geo, Domain=dom_8, Wrap=True)  # -> List, Index; disabled

# ----
# Make a Brick
panel_9 = Panel("10")  # disabled
panel_10 = Panel("15.5")  # disabled
panel_11 = Panel("32.8")  # disabled
box_6 = CenterBox(Base=subset_7.List, X=expr("x/2", panel_11), Y=expr("x/2", panel_10), Z=expr("x/2", panel_9))  # disabled

item_5 = ListItem(List=box_6, Index=series_2, Wrap=True)  # disabled
preview_5 = CustomPreview(Geometry=item_5, Material=swatch_3)  # disabled
