# Grasshopper definition Wave Form Python.ghx (Grasshopper 1.0.7)

number_slider = Slider(0.9, range=0..1)
number_slider_2 = Slider(0.2, range=0..1)
panel = Panel("175")
multiplication = Multiplication(A=Slider(2, range=1..4), B=Slider(0.25, range=0..1))
multiplication_2 = Multiplication(A=Slider(2, range=1..4), B=Slider(0.25, range=0..1))
rad = Radians(Degrees=Slider(15, range=0..100))
rad_2 = Radians(Degrees=Slider(15, range=0..100))
python = GhPythonScript(
    r=Slider(175, range=0..1000),
    t=multiplication_2,
    div=Slider(60, range=0..100),
    h=Slider(160, range=0..200),
    tilt=Slider(2, range=1..6),
    gap_z=Slider(0, range=0..10),
    bricks_angle=rad)  # -> out, up_crv, base_pts, base_crv, vec_xy_pl, wall, grid_pts, brick_pts; inputs div: Int32, gap_z: Int32
# ---------- python: Python ----------
__author__ = "jiang"
__version__ = "2022.11.03"

import rhinoscriptsyntax as rs
import Rhino.Geometry as rg
import Rhino
import math
import copy

length = 30
width = 15
height = 10

#make and reparameterize circle to crv
base_crv = rg.Circle.ToNurbsCurve(rg.Circle(rg.Point3d(0,0,0),r))
base_crv.Domain = rg.Interval(0,1)

# make the a point on circle as end point
id_pt = rg.Curve.ChangeClosedCurveSeam(base_crv,t)

#t value on circle
para = rg.Curve.DivideByCount(base_crv, div, True)

#base points for curv
base_pts = []
for p in para:
    base_pts.append(base_crv.PointAt(p))
    
#rotation direction
vec_xy_pl = rg.Vector3d(base_pts[0]-rg.Point3d(0,0,0))

# z_value of upper points
z_value=[]
for i in range(len(base_pts)):
    z_value.append(math.sin(((4*math.pi/len(base_pts))*i)+math.pi*0.5)*r/5)

#upper points for crv
up_pts = copy.deepcopy(base_pts)

for i, pt in enumerate(up_pts):
    tranMatrix = rg.Transform.Translation(rg.Vector3d(0, 0,z_value[i]+h))
    pt.Transform(tranMatrix)

for p, pt in enumerate(up_pts):
    pt.Transform(rg.Transform.Translation(vec_xy_pl/tilt))

#add end_pt to close the curve
end_pt= copy.copy(up_pts[0])
up_pts.append(end_pt)
up_crv = rg.Curve.CreateInterpolatedCurve(up_pts, 3,rg.CurveKnotStyle(3))


#crvs to wall brep
loft_crvs = [base_crv, up_crv]
wall = rg.Brep.CreateFromLoft(loft_crvs, rg.Point3d.Unset, rg.Point3d.Unset, rg.LoftType.Tight, False)


# from base_pts to pt_grid 
#a)difine layers
grid_length = base_pts[0].DistanceTo(up_pts[0])
grid_layer_cnt = int(math.ceil(grid_length/height))
#b)define move direction
grid_direction = rg.Vector3d(rg.Point3d(0,0,z_value[0]+h)-rg.Point3d(0,0,0))+(vec_xy_pl/tilt)
#c) move angle to xy_plane
grid_angle = rg.Vector3d.VectorAngle(grid_direction, vec_xy_pl)
grid_direction.Unitize()
#d) move distance of each pt
grid_unit = height/math.sin(grid_angle)+gap_z

grid_pts=[]
for h in range(grid_layer_cnt):
#    plane_pts = []
    for pt in base_pts:
        pt = copy.copy(pt)
        t = rg.Transform(rg.Transform.Translation(h*(grid_direction*grid_unit)))
        pt.Transform(t)
#        plane_pts.append(pt)
        grid_pts.append(pt)

#seclect brick pts
brick_pts = grid_pts[::2]
# ---------- end python ----------
python_2 = GhPythonScript(
    r=Slider(175, range=0..1000),
    t=multiplication,
    div=Slider(60, range=0..100),
    h=Slider(120, range=0..120),
    tilt=Slider(6, range=1..6),
    gap_z=Slider(0, range=0..10),
    bricks_angle=rad_2)  # -> out, up_crv, base_pts, base_crv, vec_xy_pl, wall, grid_pts, brick_pts; inputs div: Int32, gap_z: Int32
# ---------- python_2: Python ----------
__author__ = "jiang"
__version__ = "2022.11.03"

import rhinoscriptsyntax as rs
import Rhino.Geometry as rg
import Rhino
import math
import copy

length = 30
width = 15
height = 10

#make and reparameterize circle to crv
base_crv = rg.Circle.ToNurbsCurve(rg.Circle(rg.Point3d(0,0,0),r))
base_crv.Domain = rg.Interval(0,1)

# make the a point on circle as end point
id_pt = rg.Curve.ChangeClosedCurveSeam(base_crv,t)

#t value on circle
para = rg.Curve.DivideByCount(base_crv, div, True)

#base points for curv
base_pts = []
for p in para:
    base_pts.append(base_crv.PointAt(p))
    
#rotation direction
vec_xy_pl = rg.Vector3d(base_pts[0]-rg.Point3d(0,0,0))

# z_value of upper points
z_value=[]
for i in range(len(base_pts)):
    z_value.append(math.sin(((4*math.pi/len(base_pts))*i)+math.pi*1)*r/5)
#    z_value.append(math.sin(((4*math.pi/len(base_pts))*i)+math.pi*0.5)*r/5)

#upper points for crv
up_pts = copy.deepcopy(base_pts)

for i, pt in enumerate(up_pts):
    tranMatrix = rg.Transform.Translation(rg.Vector3d(0, 0,z_value[i]+h))
    pt.Transform(tranMatrix)

for p, pt in enumerate(up_pts):
    pt.Transform(rg.Transform.Translation(vec_xy_pl/tilt))

#add end_pt to close the curve
end_pt= copy.copy(up_pts[0])
up_pts.append(end_pt)
up_crv = rg.Curve.CreateInterpolatedCurve(up_pts, 3,rg.CurveKnotStyle(3))


#crvs to wall brep
loft_crvs = [base_crv, up_crv]
wall = rg.Brep.CreateFromLoft(loft_crvs, rg.Point3d.Unset, rg.Point3d.Unset, rg.LoftType.Tight, False)


# from base_pts to pt_grid 
#a)difine layers
#Alternative_grid_length = base_pts[0].DistanceTo(up_pts[0])
grid_length = 
grid_layer_cnt = int(math.ceil(grid_length/height))
#b)define move direction
grid_direction = rg.Vector3d(rg.Point3d(0,0,z_value[0]+h)-rg.Point3d(0,0,0))+(vec_xy_pl/tilt)
#c) move angle to xy_plane
grid_angle = rg.Vector3d.VectorAngle(grid_direction, vec_xy_pl)
grid_direction.Unitize()
#d) move distance of each pt
grid_unit = height/math.sin(grid_angle)+gap_z

grid_pts=[]
for h in range(grid_layer_cnt):
    plane_pts = []
    for pt in base_pts:
        pt = copy.copy(pt)
        t = rg.Transform(rg.Transform.Translation(h*(grid_direction*grid_unit)))
        pt.Transform(t)
        plane_pts.append(pt)
    grid_pts.append(plane_pts)

#seclect brick pts
brick_pts = []
for i , plane in enumerate( grid_pts):
    if i%2== 0:
        brick_pt = grid_pts[::2]
    else:
        brick_pt = grid_pts[1::2]
    brick_pts.append(brick_pt)
    
print type(brick_pts)
# ---------- end python_2 ----------
brep = Brep(python.wall)
pt = Point(python.grid_pts)
pt_2 = Point(python.brick_pts)
crv = Curve(python.base_crv)
python_3 = GhPythonScript(x=python_2.brick_pts)  # -> out, a
# ---------- python_3: Python ----------
__author__ = "jiang"
__version__ = "2022.11.08"

import rhinoscriptsyntax as rs

a= x
# ---------- end python_3 ----------
box = DomainBox(Base=PlaneXY(0, 0, 0), X=Slider(15, range=0..100), Y=Slider(30, range=0..100), Z=Slider(10, range=0..10))
brep_2 = Brep(python_2.wall)
rad_3 = Radians(Degrees=Slider(15, range=0..100))
python_4 = GhPythonScript(x=python_3.a)  # -> out, a; same code as python_3
item = ListItem(List=pt_2, Index="6", Wrap=True)
item_2 = ListItem(List=pt_2, Index="36", Wrap=True)
yz = YZPlane(Origin=Point(0, 0, 0))
pt_3 = Point(python_4.a)
vec2pt = Vector2Pt(PointA=item, PointB=item_2, Unitize=False)  # -> Vector, Length
rotate = Rotate(Geometry=box, Angle=rad_3, Plane=yz)  # -> Geometry, Transform
panel_2 = Panel(python_4.a)
rotate_2 = Rotate(Geometry=rotate.Geometry, Angle=1.570796327, Plane=PlaneXY(0, 0, 0))  # -> Geometry, Transform
unit = UnitVector(Vector=vec2pt.Vector)
series = Series(Start=0, Step=Slider(10.2, range=0..100), Count=Slider(25, range=0..100))
multiplication_3 = Multiplication(A=unit, B=series)

# ----
# Make a Brick
B = Base(PlaneXY(0, 0, 0))
division = Division(A="10", B="2")
box_2 = CenterBox(Base=B, X=expr("x/2", "32.8"), Y=expr("x/2", "15.5"), Z=expr("x/2", "10"))
Z = UnitZ(Factor=division)
move = Move(Geometry=box_2, Motion=Z)  # -> Geometry, Transform

move_2 = Move(Geometry=crv, Motion=multiplication_3)  # -> Geometry, Transform
deplane = DeconstructPlane(Plane=B)  # -> Origin, XAxis, YAxis, ZAxis
dispatch = Dispatch(List=move_2.Geometry, DispatchPattern=[True, False])  # -> graft(ListA), graft(ListB)

range = Range(Domain=Domain(0, 1), Steps=Slider(30, range=0..100))
graph = GraphMapper(
    range,
    x0=0,
    x1=1,
    y0=0,
    y1=1,
    container_name="Sine",
    Equation_px=[0.007785962895, 0.2544272542],
    Equation_py=[0.4870889783, 1])
shift = ShiftList(List=graph, Shift="-1", Wrap=invert(True))
ma = MassAddition(Input=shift)  # -> Result, PartialResults
bnd = Bounds(Numbers=ma.PartialResults)
remap = RemapNumbers(Value=ma.PartialResults, Source=bnd, Target=Domain(0, 1))  # -> Mapped, Clipped
eval = EvaluateLength(Curve=dispatch.ListA, Length=remap.Mapped, Normalized=True)  # -> Point, Tangent, Parameter
pl = PlaneNormal(Origin=eval.Point, ZAxis=Vector(0, 0, 1))
shatter = Shatter(Curve=dispatch.ListA, Parameters=eval.Parameter)
curvepoint = PointOnCurve(shatter, parameter=0.5)
move_3 = Move(Geometry=curvepoint, Motion=Vector(0, 0, 10))  # -> simplify(Geometry), Transform

rot3d = Rotate3D(Geometry=B, Angle=degrees(Slider(10, range=0..10)), Center=Point(0, 0, 0), Axis=deplane.YAxis)  # -> Geometry, Transform

# ---- group: First Layer
orient = Orient(Geometry=move.Geometry, Source=B, Target=pl)  # -> Geometry, Transform

# ---- group: Second Layer
orient_2 = Orient(Geometry=move.Geometry, Source=B, Target=move_3.Geometry)  # -> Geometry, Transform

# ----
merge = Merge(Data1=orient.Geometry, Data2=orient_2.Geometry)  # -> flatten(Result)
bbx = BrepBrep(BrepA=brep, BrepB=merge)  # -> Curves, Points
colom = CollisionOneMany(Collider=merge, Obstacles=brep)  # -> Collision, Index
cull = CullPattern(List=merge, CullPattern=colom.Collision)
Y = UnitY(Factor=1)
volume = Volume(Geometry=cull)  # -> Volume, Centroid
Y_2 = UnitY(Factor=1)
rot3d_2 = Rotate3D(Geometry=cull, Angle=degrees(Slider(10, range=0..10)), Center=volume.Centroid, Axis=Y)  # -> Geometry, Transform
rot3d_3 = Rotate3D(Geometry=cull, Angle=degrees(Slider(10, range=0..10)), Center=Point(0, 0, 0), Axis=Y_2)  # -> Geometry, Transform
panel_3 = Panel(cull)

volume_2 = Volume(Geometry=rot3d_2.Geometry)  # -> Volume, Centroid
pdecon = Deconstruct(Point=volume_2.Centroid)  # -> XComponent, YComponent, ZComponent
flatten = FlattenTree(Tree=pdecon.ZComponent, Path="{0}")
flatten_2 = FlattenTree(Tree=rot3d_2.Geometry, Path="{0}")
sort = SortList(Keys=flatten, ValuesA=flatten_2)  # -> Keys, ValuesA
larger = LargerThan(FirstNumber=sort.Keys, SecondNumber=Slider(45, range=0..100))  # -> LargerThan, OrEqualTo
dispatch_2 = Dispatch(List=sort.ValuesA, DispatchPattern=larger.LargerThan)  # -> ListA, ListB
geo = Geometry(dispatch_2.ListA)
series_2 = Series(Start=0, Step=1, Count=Slider(407, range=1..407))
item_3 = ListItem(List=geo, Index=series_2, Wrap=True)
preview = CustomPreview(Geometry=item_3, Material=ColourSwatch(SwatchColor=RGB(0, 187, 255)))

volume_3 = Volume(Geometry=rot3d_3.Geometry)  # -> Volume, Centroid
pdecon_2 = Deconstruct(Point=volume_3.Centroid)  # -> XComponent, YComponent, ZComponent
flatten_3 = FlattenTree(Tree=pdecon_2.ZComponent, Path="{0}")
flatten_4 = FlattenTree(Tree=rot3d_3.Geometry, Path="{0}")
sort_2 = SortList(Keys=flatten_3, ValuesA=flatten_4)  # -> Keys, ValuesA
larger_2 = LargerThan(FirstNumber=sort_2.Keys, SecondNumber=Slider(54, range=0..100))  # -> LargerThan, OrEqualTo
dispatch_3 = Dispatch(List=sort_2.ValuesA, DispatchPattern=larger_2.LargerThan)  # -> ListA, ListB
geo_2 = Geometry(dispatch_3.ListA)
series_3 = Series(Start=0, Step=1, Count=Slider(407, range=1..407))
item_4 = ListItem(List=geo_2, Index=series_3, Wrap=True)
preview_2 = CustomPreview(Geometry=item_4, Material=ColourSwatch(SwatchColor=RGB(255, 94, 94)))
