# Grasshopper definition infinite_clock.ghx (Grasshopper 1.0.7)

# ----
# Python Scripts
ghpython_script = GhPythonScript(file_name="infinite_clock.py")  # -> path
# ---------- ghpython_script: Python ----------
a = ghdoc.Path
b = ghdoc.Name

path = (a[::-1].replace('xhg.'+b[::-1].replace('*','',1),'',1))[::-1]

path = path.split('\\')

hierarchy_number = len(file_name.split('\\'))
out_path =''
for n in range(len(path)-hierarchy_number):
    out_path += path[n] +'\\'
out_path += file_name
path = out_path
#+file_name
# ---------- end ghpython_script ----------

ghpython_script_2 = GhPythonScript(file_name="data.json")  # -> path; same code as ghpython_script
read_file = ReadFile(File=ghpython_script, PerLineParse=False)

count = Slider(0, range=0..100)
ghpython_script_3 = GhPythonScript(Code=read_file, Path=ghpython_script_2, Count=count, Read=Button())  # -> Out, InitVisual, TargetVisual, RemovePlanes, PutPlanes, OutTemp
panel = Panel(ghpython_script_3.Out)
geometry = Geometry({Plane=PlaneXY(0, 0, 5), X=Domain(-16.4, 16.4), Y=Domain(-7.75, 7.75), Z=Domain(-5, 5)})
panel_2 = Panel(ghpython_script_3.OutTemp)
orient = Orient(Geometry=geometry, Source=PlaneXY(0, 0, 0), Target=ghpython_script_3.InitVisual)  # -> Geometry, Transform
orient_2 = Orient(Geometry=geometry, Source=PlaneXY(0, 0, 0), Target=ghpython_script_3.TargetVisual)  # -> Geometry, Transform
orient_3 = Orient(Geometry=geometry, Source=PlaneXY(0, 0, 0), Target=ghpython_script_3.OutTemp)  # -> Geometry, Transform
