# Grasshopper definition 20221028_302_ur_script_pick_place.gh (Grasshopper 1.0.7)
# plug-ins: treesloth01

# ---- group: BRICK DIMENSIONS / width
panel = Panel("15")

# ---- group: BRICK DIMENSIONS / height
panel_2 = Panel("10")

# ---- group: BRICK DIMENSIONS / length
panel_3 = Panel("32")

# ----
pt = ConstructPoint(XCoordinate=Slider(471, range=0..1000), YCoordinate=Slider(754, range=0..1000), ZCoordinate=0)
cir = Circle(Plane=pt, Radius=Slider(86, range=0..1000))

# ----
# Toggle freedrive to move robot
toggle = BooleanToggle(True)
toggle_freedrive = GhPythonScript(ip="192.168.10.10", start_teach_mode=toggle, stop_teach_mode=Toggle(False))  # -> a
# ---------- toggle_freedrive: Python ----------
import os
import math

from compas.rpc import Proxy

if start_teach_mode:   
    canvas = ghenv.Component.OnPingDocument()
    path = os.path.abspath(os.path.dirname(canvas.FilePath))
    rtde = Proxy('fabrication', path=path)                         # stay in teach moded(freedrive) as long as this is True
    a = rtde.start_teach_mode(ip=ip)            # send message to robot
    ghenv.Component.Message = "Freedrive on"    # display message on GH component

if stop_teach_mode:   
    canvas = ghenv.Component.OnPingDocument()
    path = os.path.abspath(os.path.dirname(canvas.FilePath))
    rtde = Proxy('fabrication', path=path)                          # stop teach mode if stop button pressed
    a = rtde.stop_teach_mode(ip=ip)             # send message to robot   
    ghenv.Component.Message = "Freedrive off"   # display message on GH component
# ---------- end toggle_freedrive ----------

X = UnitX(Factor=Slider(153, range=0..1000))
Z = UnitZ(Factor="9")
Y = UnitY(Factor=Slider(146, range=0..1000))
panel_4 = Panel(toggle_freedrive)
addition = Addition(A=Z, B=X, C=Y)
number_slider = Slider(36, range=0..120)
panel_5 = Panel("""0
1""")

B = Base(PlaneXY(0, 0, 0))
cir_2 = Circle(Plane=PlaneXY(0, 0, 0), Radius=Slider(87, range=0..1000))
number_slider_2 = Slider(20, range=0..100)
division = Division(A=number_slider_2, B="2")
panel_6 = Panel(division)
Z_2 = UnitZ(Factor="10")

division_2 = Division(A="10", B="2")
box = CenterBox(Base=B, X=expr("x/2", "32"), Y=expr("x/2", "15"), Z=expr("x/2", "10"))
Z_3 = UnitZ(Factor=division_2)
move = Move(Geometry=box, Motion=Z_3)  # -> Geometry, Transform

series = Series(Start=0, Step="10", Count=Slider(12, range=0..100))
Z_4 = UnitZ(Factor=series)
move_2 = Move(Geometry=cir_2, Motion=Z_4)  # -> simplify(Geometry), Transform
dispatch = Dispatch(List=move_2.Geometry, DispatchPattern=[True, False])  # -> ListA, ListB
hframes = HorizontalFrames(Curve=dispatch.ListA, Count=number_slider_2)  # -> Frames, Parameters
hframes_2 = HorizontalFrames(Curve=dispatch.ListB, Count=number_slider_2)  # -> Frames, Parameters
dispatch_2 = Dispatch(List=hframes.Frames, DispatchPattern=[True, False])  # -> ListA, ListB
dispatch_3 = Dispatch(List=hframes_2.Frames, DispatchPattern=[True, False])  # -> ListA, ListB
pln = Plane(simplify(dispatch_2.ListA))
pln_2 = Plane(simplify(dispatch_3.ListB))
path_mapper = PathMapper(pln_2, source="(A)", target="(A;+1)")
merge = Merge(Data1=pln, Data2=path_mapper)  # -> simplify(Result)
renumber = RenumberPaths(Data=merge)
move_3 = Move(Geometry=renumber, Motion=Z_2)  # -> Geometry, Transform
flatten = FlattenTree(Tree=move_3.Geometry, Path="{0}")
lng = ListLength(List=flatten)
series_2 = Series(Start=0, Step=1, Count=lng)
orient = Orient(Geometry=move.Geometry, Source=B, Target=flatten)  # -> Geometry, Transform
gradient = Gradient(
    LowerLimit=0,
    UpperLimit=lng,
    Parameter=series_2,
    stops=[0: RGB(234, 38, 0), 0.25: RGB(234, 126, 0), 0.5: RGB(254, 244, 84), 0.75: RGB(173, 203, 249), 1: RGB(75, 107, 169)])
preview = CustomPreview(Geometry=flatten, Material=gradient)

# ----
# Export Plane
branch = TreeBranch(Tree=move_3.Geometry, Path=panel_5, MaintainPaths=True)

geo = Geometry(flatten(branch))

# ---- group: GET CRV PLANES
crv = Curve(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)
python = GhPythonScript(crv=cir, height=panel_2, length=panel_3, width=panel)  # -> planes, brick_meshes; inputs crv: Curve
# ---------- python: Python ----------
"""
MasDfab 22-23

Basic example to get planes from crv

"""

import Rhino.Geometry as rg
import copy



def brick(pln):
    """ List of rg.Points definding the corners of the brick 
    
    Returns
    ----------
    [pt0 : bottom point at negative x and negative y,
    pt1 : bottom point at negative x and positive y,
    pt2 : bottom point at positive x and positive y,
    pt3 : bottom point at positive x and negative y,
    pt4 : pt0 + height,
    pt5 : pt1 + height,
    pt6 : pt2 + height,
    pt7 : pt3 + height]
    """
    

    
    origin = pln.Origin
    
    x_vec = pln.XAxis 
    y_vec = pln.YAxis 
    z_vec = pln.ZAxis
    
    pt_0 = origin - (x_vec *width/2) - (y_vec *length/2)
    pt_1 = origin + (x_vec *width/2) - (y_vec *length/2)
    pt_2 = origin + (x_vec *width/2) + (y_vec *length/2)
    pt_3 = origin - (x_vec *width/2) + (y_vec *length/2)
    
    pt_4 = pt_0 + (z_vec*height)
    pt_5 = pt_1 + (z_vec*height)
    pt_6 = pt_2 + (z_vec*height)
    pt_7 = pt_3 + (z_vec*height)
    
    pts = [pt_0, pt_1, pt_2, pt_3, pt_4, pt_5, pt_6, pt_7]
    
    
    return pts

def mesh(pts):
    """Mesh  depicting the brick:

    Returns
    ----------
    mesh_brick : Mesh
    """
    mesh_brick = rg.Mesh.CreateFromBox(pts, 1,1,1)
    return mesh_brick

def pick_plane(plane):
    """offsets the plane of the brick with its height. 
    Returns
    ----------
    pick_plane : rg.Plane
    """
    
    offset_vec = plane.ZAxis * height
    pick_plane = copy.copy(plane)
    pick_plane.Translate(offset_vec) 
    
    return pick_plane


gap = 10
params = crv.DivideByLength(length+gap,True)
planes = []

for i in params:
    
    p = crv.PointAt(i)
    t = crv.TangentAt(i)
    
    v = rg.Vector3d.CrossProduct(t, rg.Vector3d.ZAxis)
    
    pn =  rg.Plane(p,v,t)
    
    planes.append(pn)



brick_pts = [brick(p) for p in planes]
brick_meshes = [mesh(m) for m in brick_pts]
brick_planes = [pick_plane(p) for p in planes]
# ---------- end python ----------
mesh = Mesh(python.brick_meshes)
pln_3 = Plane(geo)

# ----
move_4 = Move(Geometry=pln_3, Motion=addition)  # -> Geometry, Transform
rotate = Rotate(Geometry=move_4.Geometry, Angle=1.570796327, Plane=move_4.Geometry)  # -> Geometry, Transform

# ---- group: FABRICATION WORKFLOW
python_2 = GhPythonScript(brick_planes=rotate.Geometry, fabricate=Button())  # -> script, vis_planes, pick_up_plane; inputs brick_planes: list of Plane, fabricate: Boolean
# ---------- python_2: Python ----------
from imp import reload
import Rhino.Geometry as rg
import simple_ur_script as ur
reload(ur)
import simple_comm as c
reload(c)
import math as m
from compas.geometry import Frame
from compas_rhino.conversions import frame_to_rhino


# change these values if needed
ROBOT_IP = "192.168.10.10"
SAFE_ROBOT_ACC = 0.1
SAFE_ROBOT_VEL = 0.1
IO = 0 # 0




def tcp(script):
    script += ur.set_tcp_by_angles(0.0, 0.0, 80.0, m.radians(0.0), m.radians(180.0),m.radians(0.0))
    
    return script


def set_robot_base():
    pt_0 = rg.Point3d(-249.62,-750.86,-587.98) # base plane origin
    pt_1 = rg.Point3d(-252.73,-1064.50,-587.82) # point on positive x axis
    pt_2 = rg.Point3d(826.13,-752.45,-587.91) # point on positive xy plane
    robot_base = rg.Plane(pt_0,pt_1-pt_0,pt_2-pt_0)
    return robot_base


def rhino_to_robot_space(rhino_plane):
    plane = rhino_plane.Clone()
    robot_base_plane = set_robot_base()
    rhino_matrix = rg.Transform.PlaneToPlane(rg.Plane.WorldXY,robot_base_plane)
    plane.Transform(rhino_matrix)
    return plane


def pickup_brick(script,pick_up_plane):
    planes = []
    #change the distance if needed
    SAFE_DIST = 150
    
    safe_plane = pick_up_plane.Clone()
    safe_plane.Translate(rhinoplane.ZAxis*SAFE_DIST)
    
    ## add to the path: go to the safe plane
    script += ur.move_l(safe_plane, SAFE_ROBOT_ACC, SAFE_ROBOT_VEL)
    planes.append(safe_plane)
    
    ## add to the path: go to the pick up plane
    script += ur.move_l(pick_up_plane, SAFE_ROBOT_ACC, SAFE_ROBOT_VEL)
    planes.append(pick_up_plane)
    
    ## add to the path: turn on the vacuum and wait 1 sec.
    script += ur.set_digital_out(IO,True)
    script += ur.sleep(1)

    # add to the path: go back to the safe_plane
    script += ur.move_l(safe_plane, SAFE_ROBOT_ACC, SAFE_ROBOT_VEL)
    planes.append(safe_plane)
    
    
    return script, planes


def place_brick(script, place_plane):
    
    planes = []
    
    SAFE_DIST = 100
    safe_plane = place_plane.Clone()
    safe_plane.Translate(rg.Vector3d.ZAxis*SAFE_DIST)
    
    # add to the path: go to the safe plane
    script += ur.move_l(safe_plane, SAFE_ROBOT_ACC, SAFE_ROBOT_VEL)
    planes.append(safe_plane)
    
    # add to the path: go to the place plane
    script += ur.move_l(place_plane, SAFE_ROBOT_ACC, SAFE_ROBOT_VEL)
    planes.append(place_plane)
    
    ## add to the path: turn off the vacuum and wait 1 second (hold the brick)
    script += ur.set_digital_out(IO,False)
    script += ur.sleep(1)
    
    # add to the path: go back to the safe plane
    script += ur.move_l(safe_plane, SAFE_ROBOT_ACC, SAFE_ROBOT_VEL)
    planes.append(safe_plane)
    
    return script,planes


def send(script):
    script = c.concatenate_script(script)
    c.send_script(script, ROBOT_IP)
    return script 


#location of a pick up station
axisangle = Frame.from_axis_angle_vector([3.293,4.493,-0.175],[414.21,-714.25,-564.70])
rhinoplane = frame_to_rhino(axisangle)
print rhinoplane
pick_station = rg.Plane(rhinoplane)#Rotate Plane


script = ""
#skip this step
script = tcp(script)
vis_planes = []



# translate from rhino to robot_space and iterate through all planes
robot_planes = []

for p in brick_planes:
    r_plane = rhino_to_robot_space(p)
    robot_planes.append(r_plane)


for b_plane in robot_planes:
    
    script, p = pickup_brick(script,pick_station)
    vis_planes.extend(p) #only to visualize the planes
    
    script, p = place_brick(script,b_plane)
    vis_planes.extend(p)


if fabricate:
    send(script)
# ---------- end python_2 ----------
pln_4 = Plane(python_2.vis_planes)
panel_7 = Panel(python_2.script)

# ----
pln_5 = Plane(python_2.pick_up_plane)
points = PointList(Points=rotate.Geometry, Size=Slider(9, range=0..100))
