# Grasshopper definition 20221031_Pick & Place_Circle Brick_BR0.1.gh (Grasshopper 1.0.7)
# plug-ins: treesloth01

number_slider = Slider(20, range=0..100)  # disabled
number_slider_2 = Slider(3, range=0..100)  # disabled
angle = Slider(-27, range=-90..90)  # disabled
crv = Curve(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)  # disabled
python = GhPythonScript(crv=crv, layer_num=number_slider_2, bricks_num=number_slider, bricks_angle=angle)  # -> out, a, pt_bricks, crvs, bricks, planes; inputs crv: Curve, layer_num: Int32, bricks_num: Int32, bricks_angle: Int32; disabled
# ---------- python: Python ----------
import rhinoscriptsyntax as rs
import Rhino.Geometry as rg
import math
import copy
import System
import ghpythonlib.treehelpers as th

length = 30
width = 15
height = 10

# bricks_angle

class Brickwall(object):
    
    """
    this is a class to create a wall from a input curve and get the origin for its bricks
    
    """
    
    # this varible was defined outside of the class
    # we need to declare it as global so it will be shared by all instances of the class
    global height
    
    
    # this method gets calles as soon as the object of a class is initiated
    # here we define instance variables = attributes of the object
    def __init__(self,curve,layer_cnt, brick_cnt):
        
        self.curve = curve
        self.layer_cnt = layer_cnt
        self.brick_cnt = brick_cnt
        
        self.crvs = self.get_layers()
        self.bpts,self.bpts_tan = self.get_bricks()
        
    # this method will be called in the __init__ function
    # it returns a list of curves 
    def get_layers(self):
        
        crvs = []
        for i in range(self.layer_cnt):
            T = rg.Transform.Translation(rg.Vector3d(0,0,i*height))
            c = copy.copy(self.curve)
            c.Transform(T)
            crvs.append(c)
        return crvs
    
    # this method will be called in the __init__ function as well
    # it divides the curves into points and returns the list of points and its tangents
    def get_bricks(self):
        
        bricks = []
        bricks_tan = []
        
        for i, c in enumerate(self.crvs):
            params = c.DivideByCount(self.brick_cnt*2,True)
            pts = []
            tngts = []
            # list comprehension
            pts = [ c.PointAt(p) for p in params[i%2::2]]
            tngts = [ c.TangentAt(p) for p in params[i%2::2]]
                
            bricks.append(pts)
            bricks_tan.append(tngts)
            
        return bricks,bricks_tan


class Brick(object):
    
    """
    this is a class to make a brick
    """
    
    global length
    global width
    global height

    # this method gets calles as soon as the object of a class is initiated
    # here we define instance variables = attributes of the object
    def __init__(self, origin, vec):
        
        
        self.origin = origin 
        self.vec = vec # point's tangent vector

        
        self.pts = self.brick_pts()
        
        self.start_plane = self.get_start_plane()
        self.target_plane = self.get_target_plane()
        
        self.mesh = self.brick_mesh()
        
        
    # this method will be called in the __init__ function
    # it returns a list of 8 points of the bounding box 
    def brick_pts(self):
        
        pt_0 = rg.Point3d(self.origin.X-length/2, self.origin.Y-width/2, self.origin.Z)
        pt_1 = rg.Point3d(pt_0.X + length, pt_0.Y, self.origin.Z)
        pt_2 = rg.Point3d(pt_1.X, pt_1.Y + width, self.origin.Z)
        pt_3 = rg.Point3d(pt_2.X - length, pt_2.Y, self.origin.Z)

        pt_4 = rg.Point3d(pt_0.X, pt_0.Y, pt_0.Z + height)
        pt_5 = rg.Point3d(pt_1.X, pt_1.Y, pt_1.Z + height)
        pt_6 = rg.Point3d(pt_2.X, pt_2.Y, pt_2.Z + height)
        pt_7 = rg.Point3d(pt_3.X, pt_3.Y, pt_3.Z + height)

        b_pts = [pt_0, pt_1, pt_2, pt_3, pt_4, pt_5, pt_6, pt_7]

        return b_pts
    
    # this method is called in the __init__ function
    # it returns the start_plane of the brick accodring to boolean input
    def get_start_plane(self):
        
        yvec = rg.Vector3d.CrossProduct(rg.Vector3d(0,0,1), self.vec)
        start_plane = rg.Plane(self.origin, self.vec, yvec)
            
        return start_plane
    
    # this method is called in the __init__ function
    # it returns the rotated start plabe plane according to input value 
    def get_target_plane(self):
        c = copy.copy(self.start_plane)
        c.Rotate(math.radians(bricks_angle), rg.Vector3d.ZAxis, self.origin)
        return c
    
    # this method is called in the __init__ funciton
    # it creates the mesh from 8 points, transforms its plane and returns the mesh 
    def brick_mesh(self):
        br = rg.Mesh.CreateFromBox(self.pts,1,1,1)
        P = rg.Plane(self.origin, rg.Vector3d.XAxis, rg.Vector3d.YAxis)
        T1 = rg.Transform.PlaneToPlane(P, self.start_plane)
        T2 = rg.Transform.PlaneToPlane(self.start_plane, self.target_plane)
        br.Transform(T1)
        br.Transform(T2)
        
        return br

# calling the object
wall = Brickwall(crv,layer_num,bricks_num)
# assigning its attribute to a variable crvs
crvs = wall.crvs
# to visualize the bricks in gh we transform it to a tree
pt_bricks = th.list_to_tree(wall.bpts)

planes = []

bricks = []


for _pt,_t in zip(wall.bpts, wall.bpts_tan):
    for pt,t, in zip(_pt,_t):
        b = Brick(pt,t)
        planes.append(b.target_plane)
        bricks.append(b.mesh)
# ---------- end python ----------
panel = Panel("10")  # disabled
Z = UnitZ(Factor=panel)  # disabled
swatch = ColourSwatch(SwatchColor=RGB(99, 107, 255))  # disabled
move = Move(Geometry=python.planes, Motion=Z)  # -> Geometry, Transform; disabled
pt = Point(flatten(python.pt_bricks))  # disabled
crv_2 = Curve(python.crvs)  # disabled
mesh = Mesh(python.bricks)  # disabled
preview = CustomPreview(Geometry=mesh, Material=swatch)  # disabled
plnaxis = PlaneAxis(P=move.Geometry, B=35)  # disabled

# ---- group: backup
geometry = Geometry([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])  # disabled
geometry_2 = Geometry([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])  # disabled
geometry_3 = Geometry([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])  # disabled
geometry_4 = Geometry([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])  # disabled
geometry_5 = Geometry([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])  # disabled
geometry_6 = Geometry([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])  # disabled
geometry_7 = Geometry([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])  # disabled
geometry_8 = Geometry([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])  # disabled
geometry_9 = Geometry([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])  # disabled
geometry_10 = Geometry([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])  # disabled
geometry_11 = Geometry([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])  # disabled
merge = Merge(
    Data1=geometry_8,
    Data2=geometry,
    Data3=geometry_2,
    Data4=geometry_3,
    Data5=geometry_4,
    Data6=geometry_5,
    Data7=geometry_6,
    Data8=geometry_7,
    Data9=geometry_9,
    Data10=geometry_10,
    Data11=geometry_11)  # -> flatten(Result); disabled

# ---- group: BRICK DIMENSIONS / height
panel_2 = Panel("10")  # disabled

# ---- group: BRICK DIMENSIONS / length
panel_3 = Panel("32")  # disabled

# ---- group: BRICK DIMENSIONS / width
panel_4 = Panel("15")  # disabled

# ----
number_slider_3 = Slider(754, range=0..1000)  # disabled
number_slider_4 = Slider(471, range=0..1000)  # disabled
number_slider_5 = Slider(86, range=0..1000)  # disabled
pt_2 = ConstructPoint(XCoordinate=number_slider_4, YCoordinate=number_slider_3, ZCoordinate=0)  # disabled
cir = Circle(Plane=pt_2, Radius=number_slider_5)  # disabled
crv_3 = Curve(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)  # disabled
python_2 = GhPythonScript(crv=cir, height=panel_2, length=panel_3, width=panel_4)  # -> planes, brick_meshes; inputs crv: Curve; disabled
# ---------- python_2: Python ----------
"""
MasDfab 22-23

Basic example to get planes from crv

"""

import Rhino.Geometry as rg
import copy



def brick(pln):
    """ List of rg.Points definding the corners of the brick 
    
    Returns
    ----------
    [pt0 : bottom point at negative x and negative y,
    pt1 : bottom point at negative x and positive y,
    pt2 : bottom point at positive x and positive y,
    pt3 : bottom point at positive x and negative y,
    pt4 : pt0 + height,
    pt5 : pt1 + height,
    pt6 : pt2 + height,
    pt7 : pt3 + height]
    """
    

    
    origin = pln.Origin
    
    x_vec = pln.XAxis 
    y_vec = pln.YAxis 
    z_vec = pln.ZAxis
    
    pt_0 = origin - (x_vec *width/2) - (y_vec *length/2)
    pt_1 = origin + (x_vec *width/2) - (y_vec *length/2)
    pt_2 = origin + (x_vec *width/2) + (y_vec *length/2)
    pt_3 = origin - (x_vec *width/2) + (y_vec *length/2)
    
    pt_4 = pt_0 + (z_vec*height)
    pt_5 = pt_1 + (z_vec*height)
    pt_6 = pt_2 + (z_vec*height)
    pt_7 = pt_3 + (z_vec*height)
    
    pts = [pt_0, pt_1, pt_2, pt_3, pt_4, pt_5, pt_6, pt_7]
    
    
    return pts

def mesh(pts):
    """Mesh  depicting the brick:

    Returns
    ----------
    mesh_brick : Mesh
    """
    mesh_brick = rg.Mesh.CreateFromBox(pts, 1,1,1)
    return mesh_brick

def pick_plane(plane):
    """offsets the plane of the brick with its height. 
    Returns
    ----------
    pick_plane : rg.Plane
    """
    
    offset_vec = plane.ZAxis * height
    pick_plane = copy.copy(plane)
    pick_plane.Translate(offset_vec) 
    
    return pick_plane


gap = 10
params = crv.DivideByLength(length+gap,True)
planes = []

for i in params:
    
    p = crv.PointAt(i)
    t = crv.TangentAt(i)
    
    v = rg.Vector3d.CrossProduct(t, rg.Vector3d.ZAxis)
    
    pn =  rg.Plane(p,v,t)
    
    planes.append(pn)



brick_pts = [brick(p) for p in planes]
brick_meshes = [mesh(m) for m in brick_pts]
brick_planes = [pick_plane(p) for p in planes]
# ---------- end python_2 ----------
mesh_2 = Mesh(python_2.brick_meshes)  # disabled

# ---- group: backup
colour_swatch = ColourSwatch(SwatchColor=RGBA(232, 0, 0, 249))  # disabled
custom_preview = CustomPreview(Geometry=merge, Material=colour_swatch)  # disabled

# ----
# Make a Brick
B = Base(PlaneXY(0, 0, 0))
division = Division(A="10", B="2")
box = CenterBox(Base=B, X=expr("x/2", "32"), Y=expr("x/2", "15"), Z=expr("x/2", "10"))
Z_2 = UnitZ(Factor=division)
move_2 = Move(Geometry=box, Motion=Z_2)  # -> Geometry, Transform

# ----
# Toggle freedrive to move robot
panel_5 = Panel("192.168.10.10")

toggle_freedrive = GhPythonScript(ip=panel_5, start_teach_mode=Toggle(False), stop_teach_mode=Toggle(False))  # -> a
# ---------- toggle_freedrive: Python ----------
import os
import math

from compas.rpc import Proxy

if start_teach_mode:   
    canvas = ghenv.Component.OnPingDocument()
    path = os.path.abspath(os.path.dirname(canvas.FilePath))
    rtde = Proxy('fabrication', path=path)                         # stay in teach moded(freedrive) as long as this is True
    a = rtde.start_teach_mode(ip=ip)            # send message to robot
    ghenv.Component.Message = "Freedrive on"    # display message on GH component

if stop_teach_mode:   
    canvas = ghenv.Component.OnPingDocument()
    path = os.path.abspath(os.path.dirname(canvas.FilePath))
    rtde = Proxy('fabrication', path=path)                          # stop teach mode if stop button pressed
    a = rtde.stop_teach_mode(ip=ip)             # send message to robot   
    ghenv.Component.Message = "Freedrive off"   # display message on GH component
# ---------- end toggle_freedrive ----------

# ----
# #            for p in params[i%2::2]:
# #                pt = c.PointAt(p)
# #                t = c.TangentAt(p)
# #
# #                pts.append(pt)
# #                tngts.append(t)
panel_6 = Panel(toggle_freedrive)

# ----
# Send planes layer by layer
number_slider_6 = Slider(0, range=0..11)

Y = UnitY(Factor=1)
rot3d = Rotate3D(Geometry=B, Angle=degrees("90"), Center=Point(0, 0, 0), Axis=Y)  # -> Geometry, Transform
box_2 = CenterBox(Base=rot3d.Geometry, X=expr("x/2", "32"), Y=expr("x/2", "15"), Z=expr("x/2", "10"))
debrep = DeconstructBrep(Brep=box)  # -> Faces, Edges, Vertices
debrep_2 = DeconstructBrep(Brep=box_2)  # -> Faces, Edges, Vertices
item = ListItem(List=debrep.Vertices, Index="1", Wrap=True)
item_2 = ListItem(List=debrep_2.Vertices, Index="1", Wrap=True)
vec2pt = Vector2Pt(PointA=item_2, PointB=item, Unitize=False)  # -> Vector, Length
move_3 = Move(Geometry=rot3d.Geometry, Motion=vec2pt.Vector)  # -> Geometry, Transform
merge_2 = Merge(Data1=B, Data2=move_3.Geometry)
Y_2 = UnitY(Factor=1)
rot3d_2 = Rotate3D(Geometry=merge_2, Angle=degrees("45"), Center=Point(0, 0, 0), Axis=Y_2)  # -> simplify(Geometry), Transform
series = Series(Start=0, Step="45.25", Count=10)
renumber = RenumberPaths(Data=rot3d_2.Geometry)
X = UnitX(Factor=series)
series_2 = Series(Start=0, Step="14.14", Count=Slider(12, range=0..100))  # -> graft(Series)
move_4 = Move(Geometry=renumber, Motion=X)  # -> Geometry, Transform
Z_3 = UnitZ(Factor=series_2)
flip = FlipMatrix(Data=move_4.Geometry)  # -> reverse(simplify(Data))
item_3 = ListItem(List=flip, Index="1", Wrap=True)
item_4 = ListItem(List=flip, Index=0, Wrap=True)
deplane = DeconstructPlane(Plane=item_4)  # -> Origin, XAxis, YAxis, ZAxis
neg = Negative(Value=deplane.XAxis)
pl = ConstructPlane(Origin=deplane.Origin, XAxis=neg, YAxis=deplane.YAxis)
merge_3 = Merge(Data1=pl, Data2=item_3)
flatten = FlattenTree(Tree=merge_3, Path="{0}")
move_5 = Move(Geometry=flatten, Motion=Z_3)  # -> flatten(Geometry), Transform
plnaxis_2 = PlaneAxis(P=move_5.Geometry, B=35)
points = PointList(Points=move_5.Geometry, Size=Slider(9, range=0..100))
box_3 = CenterBox(Base=move_5.Geometry, X=expr("x/2", "32"), Y=expr("x/2", "15"), Z=expr("x/2", "10"))
series_3 = Series(Start=0, Step=1, Count=Slider(240, range=1..240))
item_5 = ListItem(List=box_3, Index=series_3, Wrap=True)

deplane_2 = DeconstructPlane(Plane=move_5.Geometry)  # -> Origin, XAxis, YAxis, ZAxis
lng = ListLength(List=box_3)
panel_7 = Panel(lng)
first_last = FirstLast(List=item_5)  # -> FirstValue, LastValue
preview_2 = CustomPreview(Geometry=first_last.LastValue, Material=ColourSwatch(SwatchColor=RGB(255, 255, 255)))

# ---- group: picking_plans
data = Data([Plane(origin=(4326.842561, 496.4232481, 95.07750284), x=(0.8660254069, 0, 0.4999999947), y=(-0.2499999971, 0.866025404, 0.4330127031)), Plane(origin=(4308.962561, 496.4232481, 95.07750284), x=(0.8660254069, 0, 0.4999999947), y=(-0.2499999971, 0.866025404, 0.4330127031)), Plane(origin=(4291.082561, 496.4232481, 95.07750284), x=(0.8660254069, 0, 0.4999999947), y=(-0.2499999971, 0.866025404, 0.4330127031)), Plane(origin=(4273.202561, 496.4232481, 95.07750284), x=(0.8660254069, 0, 0.4999999947), y=(-0.2499999971, 0.866025404, 0.4330127031)), Plane(origin=(4334.842561, 468.7104352, 81.22109634), x=(0.8660254069, 0, 0.4999999947), y=(-0.2499999971, 0.866025404, 0.4330127031)), Plane(origin=(4316.962561, 468.7104352, 81.22109634), x=(0.8660254069, 0, 0.4999999947), y=(-0.2499999971, 0.866025404, 0.4330127031))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])

# ---- group: bricks_for_displaying
data_2 = Data([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])

# ----
item_6 = ListItem(List=data, Index=0, Wrap=True)
pln = Plane(Plane(origin=(414.21, -714.25, -564.7), x=(0.842762809, 0.1355324124, 0.5209431955), y=(0.0946023538, 0.9154268812, -0.3912084097)))
orient = Orient(Geometry=data, Source=item_6, Target=pln)  # -> Geometry, Transform

# ----
# Brick Wall_Version 1
number_slider_7 = Slider(173, range=0..1000)
cir_2 = Circle(Plane=PlaneXY(0, 0, 0), Radius=number_slider_7)
series_4 = Series(Start=0, Step="10", Count=Slider(12, range=0..100))
multiplication = Multiplication(A=number_slider_7, B=Slider(2, range=0..10))
Z_4 = UnitZ(Factor=series_4)
panel_8 = Panel(multiplication)
move_6 = Move(Geometry=cir_2, Motion=Z_4)  # -> simplify(Geometry), Transform
dom = ConstructDomain(DomainStart=0, DomainEnd=Slider(45, range=0..180))
number_slider_8 = Slider(60, range=0..100)
range = Range(Domain=dom, Steps=expr("x-1", "30"))
dispatch = Dispatch(List=move_6.Geometry, DispatchPattern=[True, False])  # -> ListA, ListB
graph = GraphMapper(range, x0=0, x1=45, y0=0, y1=45, container_name="Sine", Equation_px=[0, 0.5064998269], Equation_py=[0, 1])
division_2 = Division(A=number_slider_8, B="2")
hframes = HorizontalFrames(Curve=dispatch.ListA, Count=number_slider_8)  # -> Frames, Parameters
hframes_2 = HorizontalFrames(Curve=dispatch.ListB, Count=number_slider_8)  # -> Frames, Parameters
panel_9 = Panel(division_2)
dispatch_2 = Dispatch(List=hframes.Frames, DispatchPattern=[True, False])  # -> ListA, ListB
dispatch_3 = Dispatch(List=hframes_2.Frames, DispatchPattern=[True, False])  # -> ListA, ListB
pln_2 = Plane(simplify(dispatch_2.ListA))
pln_3 = Plane(simplify(dispatch_3.ListB))
prot = RotatePlane(Plane=pln_3, Angle=degrees(graph))  # -> simplify(Plane)
neg_2 = Negative(Value=graph)
prot_2 = RotatePlane(Plane=pln_2, Angle=degrees(neg_2))  # -> simplify(Plane)
path_mapper = PathMapper(prot, source="(A)", target="(A;+1)")
merge_4 = Merge(Data1=prot_2, Data2=path_mapper)  # -> simplify(Result)
series_5 = Series(Start=0, Step="12", Count="12")  # -> graft(Series)
pt_3 = ConstructPoint(XCoordinate=0, YCoordinate=0, ZCoordinate=0)
rotate = Rotate(Geometry=merge_4, Angle=degrees(series_5), Plane=pt_3)  # -> Geometry, Transform
renumber_2 = RenumberPaths(Data=rotate.Geometry)
Z_5 = UnitZ(Factor="10")
move_7 = Move(Geometry=renumber_2, Motion=Z_5)  # -> Geometry, Transform
tstat = TreeStatistics(Tree=move_7.Geometry)  # -> Paths, Length, Count
flatten_2 = FlattenTree(Tree=move_7.Geometry, Path="{0}")
lng_2 = ListLength(List=flatten_2)
branch = TreeBranch(Tree=move_7.Geometry, Path=number_slider_6, MaintainPaths=True)
series_6 = Series(Start=0, Step=1, Count=lng_2)
gradient = Gradient(
    LowerLimit=0,
    UpperLimit=lng_2,
    Parameter=series_6,
    stops=[0: RGB(234, 38, 0), 0.25: RGB(234, 126, 0), 0.5: RGB(254, 244, 84), 0.75: RGB(173, 203, 249), 1: RGB(75, 107, 169)])
X_2 = UnitX(Factor=Slider(186, range=0..1000))
Z_6 = UnitZ(Factor="9")
Y_3 = UnitY(Factor=Slider(186, range=0..1000))
geo = Geometry(flatten(branch))
addition = Addition(B=X_2, C=Y_3)
pln_4 = Plane(geo)
move_8 = Move(Geometry=pln_4, Motion=addition)  # -> Geometry, Transform
preview_3 = CustomPreview(Geometry=flatten_2, Material=gradient)

# ----
# Brick Visualization
orient_2 = Orient(Geometry=move_2.Geometry, Source=B, Target=flatten_2)  # -> Geometry, Transform

# ----
# Export Plane
rotate_2 = Rotate(Geometry=move_8.Geometry, Angle=0, Plane=move_8.Geometry)  # -> Geometry, Transform

preview_4 = CustomPreview(Geometry=orient_2.Geometry, Material=ColourSwatch(SwatchColor=RGB(255, 255, 255)))
points_2 = PointList(Points=rotate_2.Geometry, Size=Slider(9, range=0..100))

# ---- group: FABRICATION WORKFLOW
python_3 = GhPythonScript(picking_plans=orient.Geometry, brick_planes=rotate_2.Geometry, fabricate=Button())  # -> script, vis_planes, pick_up_plane, pick_station; inputs picking_plans: list of Plane, brick_planes: list of Plane, fabricate: Boolean
# ---------- python_3: Python ----------
from imp import reload
import Rhino.Geometry as rg
import simple_ur_script as ur
reload(ur)
import simple_comm as c
reload(c)
import math as m
from compas.geometry import Frame
from compas_rhino.conversions import frame_to_rhino


# change these values if needed
ROBOT_IP = "192.168.10.10"
SAFE_ROBOT_ACC = 0.1
SAFE_ROBOT_VEL = 0.3
IO = 0 # 0


sleep_time = 0.2

def tcp(script):
    script += ur.set_tcp_by_angles(0.0, 0.0, 80.0, m.radians(0.0), m.radians(180.0),m.radians(0.0))
    
    return script


def set_robot_base():
    pt_0 = rg.Point3d(-249.62,-750.86,-587.98) # base plane origin
    pt_1 = rg.Point3d(-252.73,-1064.50,-587.82) # point on positive x axis
    pt_2 = rg.Point3d(826.13,-752.45,-587.91) # point on positive xy plane
    robot_base = rg.Plane(pt_0,pt_1-pt_0,pt_2-pt_0)
    return robot_base


def rhino_to_robot_space(rhino_plane):
    plane = rhino_plane.Clone()
    robot_base_plane = set_robot_base()
    rhino_matrix = rg.Transform.PlaneToPlane(rg.Plane.WorldXY,robot_base_plane)
    plane.Transform(rhino_matrix)
    return plane


def pickup_brick(script,pick_up_plane):
    planes = []
    #change the distance if needed
    SAFE_DIST = 150
    
    safe_plane = pick_up_plane.Clone()
#    safe_plane.Translate(rhinoplane.ZAxis*SAFE_DIST)
    safe_plane.Translate(rg.Vector3d.ZAxis*SAFE_DIST)
    
    ## add to the path: go to the safe plane
    script += ur.move_l(safe_plane, SAFE_ROBOT_ACC, SAFE_ROBOT_VEL)
    planes.append(safe_plane)
    
    ## add to the path: go to the pick up plane
    script += ur.move_l(pick_up_plane, SAFE_ROBOT_ACC, SAFE_ROBOT_VEL)
    planes.append(pick_up_plane)
    
    ## add to the path: turn on the vacuum and wait 1 sec.
    script += ur.set_digital_out(IO,True)
    script += ur.sleep(sleep_time)

    # add to the path: go back to the safe_plane
    script += ur.move_l(safe_plane, SAFE_ROBOT_ACC, SAFE_ROBOT_VEL)
    planes.append(safe_plane)
    
    
    return script, planes


def place_brick(script, place_plane):
    
    planes = []
    
    SAFE_DIST = 100
    safe_plane = place_plane.Clone()
    safe_plane.Translate(rg.Vector3d.ZAxis*SAFE_DIST)
    
    # add to the path: go to the safe plane
    script += ur.move_l(safe_plane, SAFE_ROBOT_ACC, SAFE_ROBOT_VEL)
    planes.append(safe_plane)
    
    # add to the path: go to the place plane
    script += ur.move_l(place_plane, SAFE_ROBOT_ACC, SAFE_ROBOT_VEL)
    planes.append(place_plane)
    
    ## add to the path: turn off the vacuum and wait 1 second (hold the brick)
    script += ur.set_digital_out(IO,False)
    script += ur.sleep(sleep_time)
 
    # add to the path: go back to the safe plane
    script += ur.move_l(safe_plane, SAFE_ROBOT_ACC, SAFE_ROBOT_VEL)
    planes.append(safe_plane)
    
    return script,planes


def send(script):
    script = c.concatenate_script(script)
    c.send_script(script, ROBOT_IP)
    return script 


#location of a pick up station
axisangle = Frame.from_axis_angle_vector([2.403,2.421,-4.166],[677.46,-886.44,-492.82])

pickup_planes = []

"""
for plan in  picking_plans:
    x = rg.Transform.PlaneToPlane(picking_plans[0], plan)
    plan.Transform(x)
    pickup_planes.append(rg.Plane(plan))
"""
# print rhinoplane
# pick_station = rg.Plane(rhinoplane)#Rotate Plane



#  picking_planes


script = ""
#skip this step
script = tcp(script)
vis_planes = []



# translate from rhino to robot_space and iterate through all planes
robot_planes = []

for p in brick_planes:
    r_plane = rhino_to_robot_space(p)
    robot_planes.append(r_plane)

# picking_plans
for i in range(len(robot_planes)):
    
    script, p = pickup_brick(script,picking_plans[0])
    vis_planes.extend(p) #only to visualize the planes
    
    script, p = place_brick(script,robot_planes[i])
    vis_planes.extend(p)


if fabricate:
    send(script)
# ---------- end python_3 ----------
pln_5 = Plane(python_3.vis_planes)
panel_10 = Panel(python_3.script)

# ----
pln_6 = Plane(python_3.pick_up_plane)
pln_7 = Plane(python_3.pick_station)
panel_11 = Panel(pln_7)

# ==== cluster PlaneAxis: show plane X Y Z axis.
P = ClusterInput()
B = ClusterInput()
deplane = DeconstructPlane(Plane=graft(P))  # -> Origin, XAxis, YAxis, ZAxis
multiplication = Multiplication(A=[deplane.XAxis, deplane.YAxis, deplane.ZAxis], B=B)
vdisex = VectorDisplayEx(
    Point=deplane.Origin,
    Vector=multiplication,
    Colour=[ColourSwatch(SwatchColor=RGB(235, 52, 52)), ColourSwatch(SwatchColor=RGB(90, 207, 48)), ColourSwatch(SwatchColor=RGB(54, 126, 227))],
    Width=2)
