# Grasshopper definition rectangle-shape-practice.gh (Grasshopper 1.0.7)

# IP Address
panel = Panel("192.168.10.10")

# ----
# Set TCP/Get TCP
button = Button()
get_tcp_offset = GhPythonScript(ip=panel, get_tcp=button)  # -> tcp
# ---------- get_tcp_offset: Python ----------
import os
import math
from scriptcontext import sticky as st

tcp = 'tcp_{}'.format(str(ghenv.Component.InstanceGuid))

from compas.rpc import Proxy

if tcp not in st:
    st[tcp]= None

if get_tcp:   
    canvas = ghenv.Component.OnPingDocument()
    path = os.path.abspath(os.path.dirname(canvas.FilePath))
    rtde = Proxy('fabrication', path=path)                         
    st[tcp] = rtde.get_tcp_offset(ip=ip)    

tcp = st[tcp]
# ---------- end get_tcp_offset ----------
set_tcp_offset = GhPythonScript(ip=panel, set_tcp=Button())  # -> tcp
# ---------- set_tcp_offset: Python ----------
import os
import math
from scriptcontext import sticky as st

tcp = 'tcp_{}'.format(str(ghenv.Component.InstanceGuid))

from compas.rpc import Proxy

if tcp not in st:
    st[tcp]= None

if set_tcp:   
    canvas = ghenv.Component.OnPingDocument()
    path = os.path.abspath(os.path.dirname(canvas.FilePath))
    rtde = Proxy('fabrication', path=path)  
    pose = [0.61/1000,0.0,80.06/1000,0.0,3.1415,0.0]
    st[tcp] = rtde.set_tcp_offset(pose, ip=ip)    

tcp = st[tcp]
# ---------- end set_tcp_offset ----------
panel_2 = Panel(get_tcp_offset)
panel_3 = Panel(set_tcp_offset)

# ----
# toggle freedrive
button_2 = Button()

# ----
# Get current Tool Center Point
button_3 = Button()
get_tcp_frame = GhPythonScript(get_origin=button_3, get_x=Button(), get_y=button_2, ip=panel)  # -> frame, origin, x_pt, y_pt
# ---------- get_tcp_frame: Python ----------
import os
from scriptcontext import sticky as st
#sticky is a persistent dictionary which can save values and also be acessed by other GH components
#we use it here with a custom key to store values we read from the robot
from compas.rpc import Proxy

origin_key = 'origin_{}'.format(str(ghenv.Component.InstanceGuid))
x_key = 'x_{}'.format(str(ghenv.Component.InstanceGuid))
y_key = 'y_{}'.format(str(ghenv.Component.InstanceGuid))

if origin_key not in st:
    st[origin_key] = None

if x_key not in st:
    st[x_key] = None

if y_key not in st:
    st[y_key] = None

if get_origin:
    canvas = ghenv.Component.OnPingDocument()
    path = os.path.abspath(os.path.dirname(canvas.FilePath))
    rtde = Proxy('fabrication', path=path)
    frame = rtde.get_tcp_frame(ip=ip)
    st[origin_key] = frame.point

if get_x:
    canvas = ghenv.Component.OnPingDocument()
    path = os.path.abspath(os.path.dirname(canvas.FilePath))
    rtde = Proxy('fabrication', path=path)
    frame = rtde.get_tcp_frame(ip=ip)
    st[x_key] = frame.point

if get_y:
    canvas = ghenv.Component.OnPingDocument()
    path = os.path.abspath(os.path.dirname(canvas.FilePath))
    rtde = Proxy('fabrication', path=path)
    frame = rtde.get_tcp_frame(ip=ip)
    st[y_key] = frame.point


origin = st[origin_key]
x_pt = st[x_key]
y_pt = st[y_key]
# ---------- end get_tcp_frame ----------

toggle_freedrive = GhPythonScript(ip=panel, start_teach_mode=Toggle(False), stop_teach_mode=Toggle(False))  # -> a
# ---------- toggle_freedrive: Python ----------
import os
import math

from compas.rpc import Proxy

if start_teach_mode:   
    canvas = ghenv.Component.OnPingDocument()
    path = os.path.abspath(os.path.dirname(canvas.FilePath))
    rtde = Proxy('fabrication', path=path)                         # stay in teach moded(freedrive) as long as this is True
    a = rtde.start_teach_mode(ip=ip)            # send message to robot
    ghenv.Component.Message = "Freedrive on"    # display message on GH component

if stop_teach_mode:   
    canvas = ghenv.Component.OnPingDocument()
    path = os.path.abspath(os.path.dirname(canvas.FilePath))
    rtde = Proxy('fabrication', path=path)                          # stop teach mode if stop button pressed
    a = rtde.stop_teach_mode(ip=ip)             # send message to robot   
    ghenv.Component.Message = "Freedrive off"   # display message on GH component
# ---------- end toggle_freedrive ----------

panel_4 = Panel(get_tcp_frame.y_pt)
panel_5 = Panel(get_tcp_frame.x_pt)
panel_6 = Panel(get_tcp_frame.origin)
draw = Draw(cg=get_tcp_frame.y_pt)  # -> rg
#   port cg: The COMPAS geometry or datastructure to be drawn.
#   port rg: The Rhino geometry object.
# ---------- draw: Python ----------
"""
Draws COMPAS geometry in Grasshopper.
"""
from ghpythonlib.componentbase import executingcomponent as component

from compas.artists import Artist


class CompasToRhinoGeometry(component):
    def RunScript(self, cg):
        if not cg:
            return None

        return Artist(cg).draw()
# ---------- end draw ----------
draw_2 = Draw(cg=get_tcp_frame.x_pt)  # -> rg; same code as draw
draw_3 = Draw(cg=get_tcp_frame.origin)  # -> rg; same code as draw
python = GhPythonScript(origin=draw_3, x_axis_pt=draw_2, y_axis_pt=draw)  # -> out, base_plane; inputs origin: Point3d, x_axis_pt: Point3d, y_axis_pt: Point3d
# ---------- python: Python ----------
import Rhino.Geometry as rg

if origin is not None and x_axis_pt is not None and y_axis_pt is not None:
    origin = origin*1000
    x_axis = x_axis_pt*1000
    xy_plane_pt = y_axis_pt*1000
    
    base_plane = rg.Plane(origin, x_axis, xy_plane_pt)
# ---------- end python ----------

# ----
# Create a row of bricks
number_slider = Slider(32, range=0..50)
crv = Curve(<curve referenced from the Rhino model>)
python_2 = GhPythonScript(crv=crv, length=number_slider, width=Slider(15, range=0..25), height=Slider(10, range=0..15))  # -> out, origin_frames, pickup_frames, bricks; inputs crv: Curve, length: Int32, width: Int32, height: Int32
# ---------- python_2: Python ----------
"""
MasDfab 22-23

Example of basic compas geometry and json 

"""

import os
import sys
import Rhino.Geometry as rg
import compas

from compas_rhino import conversions as c
from compas.geometry import Frame, Vector, Box
from compas.geometry import Translation

# get the gh_file name(gh_canvas) and folder directory(folder) where we will store the file
gh_canvas = ghenv.Component.OnPingDocument()
folder = os.path.dirname(gh_canvas.FilePath)

MARGIN = 2.5 #Margin between bricks

# dividing the curve by count, return the curve params
count = crv.GetLength()/(length+MARGIN)
params = crv.DivideByCount(count,True)
planes = []


for i in params:
    p = crv.PointAt(i)
    t = crv.TangentAt(i)
    v = rg.Vector3d.CrossProduct(t, rg.Vector3d(0,0,1))
    p =  rg.Plane(p,v,t)
    planes.append(p)

# using compas in-built method to transform rhino planes into compas frames
origin_frames = [c.plane_to_compas_frame(p) for p in planes]

# define translation for full height
T = Translation.from_vector(Vector(0,0,height))

# define translation for half height
T2 = Translation.from_vector(Vector(0,0,height/2))

# apply translation to origin frames
pickup_frames = [f.transformed(T) for f in origin_frames]


# create a compas mesh (Box)
bricks = [Box(f,width,length,height).transformed(T2) for f in origin_frames]
# ---------- end python_2 ----------
draw_4 = Draw(cg=python_2.pickup_frames)  # -> rg; same code as draw
draw_5 = Draw(cg=python_2.bricks)  # -> rg; same code as draw

# ----
# Picking Frame, Static position for new bricks
panel_7 = Panel("466.32")
frame_from_point = GhPythonScript(x=panel_7, y="-14.20", z="-2.50")  # -> out, frame
# ---------- frame_from_point: Python ----------
from compas.geometry import Frame,Point, Vector

frame = Frame(Point(x,y,z),Vector(1,0,0), Vector(0,1,0))
# ---------- end frame_from_point ----------

pln = Plane(Plane(origin=(520.4806028, 516.2149698, -12.66594141), x=(-0.9999933545, -2.25455549e-05, 0.003645618137), y=(3.293137014e-05, -0.9999959416, 0.002848813973)))
planes_to_frame = GhPythonScript(planes=pln)  # -> compas_frames; inputs planes: list of Plane
# ---------- planes_to_frame: Python ----------
import Rhino.Geometry as rg
from compas.geometry import Frame

from compas_rhino.conversions import plane_to_compas_frame

compas_frames = []
for p in planes:
    c_frame = plane_to_compas_frame(p)
    compas_frames.append(c_frame)
# ---------- end planes_to_frame ----------
# Base frame
panel_8 = Panel(pln)
panel_9 = Panel(python.base_plane)
panel_10 = Panel(python_2.pickup_frames)

# ----
# Send a routine sequence for pick and place using UR RTDE
number_slider_2 = Slider(0.6, range=0..2)
pick_and_place = GhPythonScript(
    base_frame=planes_to_frame,
    frames=python_2.pickup_frames,
    pick_frame=frame_from_point.frame,
    speed=number_slider_2,
    accel=Slider(0.35, range=0..3.14),
    send=Button(),
    ip=panel)  # -> a; inputs frames: list
# ---------- pick_and_place: Python ----------
import os
import math
import time
import Grasshopper.Kernel as gh
from compas.rpc import Proxy
from compas.geometry import Translation, Vector, Transformation, Frame

SAFE_DIST = 100 # fixed safety distance to offset frames by 
VACCUUM_PIN = 4 # digital output pin on the robot for the valve

pick_frame = pick_frame #static picking up location
pick_safety_frame = pick_frame.transformed(Translation.from_vector(Vector(0,0,SAFE_DIST))) #static safety plane 

#transform frames from rhino space to robot space
robot_frames = []

T = Transformation.from_frame_to_frame(Frame.worldXY(), base_frame)
for frame in frames:
    robot_frames.append(frame.transformed(T))

if send:
    if not frames: #if no frames provided, then display message
        ghenv.Component.Message = "No frame to move to!"
    else:
        canvas = ghenv.Component.OnPingDocument()
        path = os.path.abspath(os.path.dirname(canvas.FilePath))
        rtde = Proxy('fabrication', path=path)   
        for f in robot_frames:
            #move to pick safety plane
            rtde.move_to_target(pick_safety_frame, speed, accel, False, ip = ip)
            #move to pick plane
            rtde.move_to_target(pick_frame, speed, accel, False, ip = ip)
            #turn IO on
            rtde.set_digital_io(VACCUUM_PIN,True,ip=ip)
            #sleep on position to give some time to pick up
            time.sleep(0.5)
            #move to pick safety plane
            rtde.move_to_target(pick_safety_frame, speed, accel, False, ip = ip)
            #move to pre placement frame
            pre_place_frame = f.transformed(Translation.from_vector(Vector(0,0,SAFE_DIST)))
            rtde.move_to_target(pre_place_frame, speed, accel, False, ip = ip)
            #move to placement frame
            rtde.move_to_target(f, speed, accel, False, ip = ip)
            #turn vaccuum off to place brick
            rtde.set_digital_io(VACCUUM_PIN,False,ip=ip)
            #sleep robot to make sure it is placed
            time.sleep(0.5)
            #move to post placement frame
            post_place_frame = f.transformed(Translation.from_vector(Vector(0,0,SAFE_DIST)))
            rtde.move_to_target(post_place_frame, speed, accel, False, ip = ip)
        ghenv.Component.Message = "Sent frames" #display message on component
# ---------- end pick_and_place ----------
