# Grasshopper definition 20221103_demo_v2_BR.gh (Grasshopper 1.0.7)
# plug-ins: treesloth01, Noise 4D

# ----
# Make a Brick
panel = Panel("32")
B = Base(PlaneXY(0, 0, 0))
division = Division(A="10", B="2")
box = CenterBox(Base=B, X=expr("x/2", panel), Y=expr("x/2", "15"), Z=expr("x/2", "10"))
Z = UnitZ(Factor=division)
move = Move(Geometry=box, Motion=Z)  # -> Geometry, Transform

number_slider = Slider(165, range=0..1000)
number_slider_2 = Slider(4, range=0..10)  # disabled
number_slider_3 = Slider(12, range=0..100)  # disabled
series = Series(Start=0, Step=Slider(12, range=0..100), Count=10)  # -> graft(Series)
series_2 = Series(Start=0, Step=Slider(7.2, range=0..14.4), Count=10)  # -> simplify(graft(Series))
Z_2 = UnitZ(Factor=series)

# ----
# Send planes layer by layer
number_slider_4 = Slider(11, range=0..11)  # disabled

number_slider_5 = Slider(0.52, range=0..1)  # disabled
number_slider_6 = Slider(0.6, range=0..1)  # disabled
panel_2 = Panel("7")  # disabled
dom = ConstructDomain(DomainStart=0, DomainEnd=panel_2)  # disabled
neg = Negative(Value=Slider(2, range=0..10))
number_slider_7 = Slider(240, range=1..240)  # disabled
Z_3 = UnitZ(Factor=neg)

# ---- group: backup
geo = Geometry([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])
geo_2 = Geometry([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])
geo_3 = Geometry([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])
geo_4 = Geometry([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])
geo_5 = Geometry([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])
geo_6 = Geometry([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])
geo_7 = Geometry([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])
geo_8 = Geometry([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])
geo_9 = Geometry([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])
geo_10 = Geometry([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])
geo_11 = Geometry([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])
merge = Merge(
    Data1=geo,
    Data2=geo_2,
    Data3=geo_3,
    Data4=geo_4,
    Data5=geo_5,
    Data6=geo_6,
    Data7=geo_7,
    Data8=geo_8,
    Data9=geo_9,
    Data10=geo_10,
    Data11=geo_11)  # -> flatten(Result)

# ----
python = GhPythonScript(file_name="simulation.py")  # -> path
# ---------- python: Python ----------
a = ghdoc.Path
b = ghdoc.Name

path = (a[::-1].replace('xhg.'+b[::-1].replace('*','',1),'',1))[::-1]+file_name
# ---------- end python ----------
file = ReadFile(File=python, PerLineParse=False)

geo_12 = Geometry([Plane(origin=(130.5129571, 928.2940481, 95.29507717), x=(0.8660254069, 0, 0.4999999947), y=(-0.2499999971, 0.866025404, 0.4330127031)), Plane(origin=(112.6329571, 928.2940481, 95.29507717), x=(0.8660254069, 0, 0.4999999947), y=(-0.2499999971, 0.866025404, 0.4330127031)), Plane(origin=(94.75295712, 928.2940481, 95.29507717), x=(0.8660254069, 0, 0.4999999947), y=(-0.2499999971, 0.866025404, 0.4330127031)), Plane(origin=(76.87295712, 928.2940481, 95.29507717), x=(0.8660254069, 0, 0.4999999947), y=(-0.2499999971, 0.866025404, 0.4330127031)), Plane(origin=(138.512957, 900.5812352, 81.43867067), x=(0.8660254069, 0, 0.4999999947), y=(-0.2499999971, 0.866025404, 0.4330127031)), Plane(origin=(120.632957, 900.5812352, 81.43867067), x=(0.8660254069, 0, 0.4999999947), y=(-0.2499999971, 0.866025404, 0.4330127031))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])
pt = ConstructPoint(XCoordinate="0", YCoordinate="0", ZCoordinate="0")

# ---- group: backup
preview = CustomPreview(Geometry=merge, Material=ColourSwatch(SwatchColor=RGBA(232, 0, 0, 249)))

# ----
pl = ConstructPlane(Origin=pt, XAxis=Vector(1, 0, 0), YAxis=Vector(0, 1, 0))
swatch = ColourSwatch(SwatchColor=RGB(107, 107, 107))  # disabled
item = ListItem(List=merge, Index=0, Wrap=True)
item_2 = ListItem(List=merge, Index=0, Wrap=True)

toggle_freedrive = GhPythonScript(ip="192.168.10.10", start_teach_mode=Toggle(False), stop_teach_mode=Toggle(False))  # -> a
# ---------- toggle_freedrive: Python ----------
import os
import math

from compas.rpc import Proxy

if start_teach_mode:   
    canvas = ghenv.Component.OnPingDocument()
    path = os.path.abspath(os.path.dirname(canvas.FilePath))
    rtde = Proxy('fabrication', path=path)                         # stay in teach moded(freedrive) as long as this is True
    a = rtde.start_teach_mode(ip=ip)            # send message to robot
    ghenv.Component.Message = "Freedrive on"    # display message on GH component

if stop_teach_mode:   
    canvas = ghenv.Component.OnPingDocument()
    path = os.path.abspath(os.path.dirname(canvas.FilePath))
    rtde = Proxy('fabrication', path=path)                          # stop teach mode if stop button pressed
    a = rtde.stop_teach_mode(ip=ip)             # send message to robot   
    ghenv.Component.Message = "Freedrive off"   # display message on GH component
# ---------- end toggle_freedrive ----------

debrep = DeconstructBrep(Brep=item)  # -> Faces, Edges, Vertices
item_3 = ListItem(List=debrep.Faces, Index=Slider(5, range=0..10), Wrap=True)
deplane = DeconstructPlane(Plane=item_3)  # -> Origin, XAxis, YAxis, ZAxis

# ---- group: Table
geo_13 = Geometry(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)

# ---- group: Robot Base
geo_14 = Geometry(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)

# ---- group: Pickup Station
geo_15 = Geometry(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)

# ----
item_4 = ListItem(List=debrep.Vertices, Index=0, Wrap=True)  # -> Item, Item1, Item2, Item3, Item4, Item5, Item6, Item7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
geo_16 = Geometry(item_4.Item4)
python_2 = GhPythonScript(file_name="robot_listen.py")  # -> path; same code as python
vec2pt = Vector2Pt(PointA=deplane.Origin, PointB=item_4.Item6, Unitize=False)  # -> Vector, Length
vec2pt_2 = Vector2Pt(PointA=deplane.Origin, PointB=item_4.Item4, Unitize=False)  # -> Vector, Length
multiplication = Multiplication(A=vec2pt.Vector, B=0.5)
multiplication_2 = Multiplication(A=vec2pt_2.Vector, B=0.5)
file_2 = ReadFile(File=python_2, PerLineParse=False)
addition = Addition(A=multiplication, B=multiplication_2)
move_2 = Move(Geometry=deplane.Origin, Motion=addition)  # -> Geometry, Transform
python_3 = GhPythonScript(button=Toggle(True), ROBOT_IP="192.168.10.10")  # -> out, a
# ---------- python_3: Python ----------
from imp import reload
import Rhino.Geometry as rg
import simple_ur_script as ur
reload(ur)
import simple_comm as c
reload(c)
import math as m
from compas.geometry import Frame
from compas_rhino.conversions import frame_to_rhino

def tcp(script):
    # script += ur.set_tcp_by_angles(-0.35, 0.5, 89.08, m.radians(0.0), m.radians(3.1415),m.radians(0.0))
    # script += ur.set_tcp_by_angles(-0.35, 0.5, 89.08, m.radians(0.0), m.radians(0),m.radians(0.0))
    script += ur.set_tcp_by_angles(-0.35, 0.5, 89.08, 0.0, 3.1415, 1.57)
    
    return script
def send(script):
    script = c.concatenate_script(script)
    c.send_script(script, ROBOT_IP)
    return script 
    
    
    
script = ''
if button:
    script = tcp(script)
    send (script)
# ---------- end python_3 ----------
pl_2 = ConstructPlane(Origin=move_2.Geometry, XAxis=deplane.YAxis, YAxis=expr("-x", deplane.XAxis))
deplane_2 = DeconstructPlane(Plane=pl_2)  # -> Origin, XAxis, YAxis, ZAxis
geo_17 = Geometry(Plane(origin=(130.5129571, 928.2940481, 95.29507717), x=(0.8986609222, -0.1455916388, 0.4137772608), y=(-0.03696385885, 0.9148193651, 0.4021681271)))
deplane_3 = DeconstructPlane(Plane=geo_17)  # -> Origin, XAxis, YAxis, ZAxis
orient = Orient(Geometry=merge, Source=pl_2, Target=geo_17)  # -> Geometry, Transform
vec2pt_3 = Vector2Pt(PointA=deplane_2.Origin, PointB=deplane_3.Origin, Unitize=False)  # -> Vector, Length
geo_18 = Geometry()
move_3 = Move(Geometry=pl_2, Motion=vec2pt_3.Vector)  # -> Geometry, Transform
geo_19 = Geometry(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)
geo_20 = Geometry([Plane(origin=(4326.842561, 496.4232481, 95.07750284), x=(0.8660254069, 0, 0.4999999947), y=(-0.2499999971, 0.866025404, 0.4330127031)), Plane(origin=(4308.962561, 496.4232481, 95.07750284), x=(0.8660254069, 0, 0.4999999947), y=(-0.2499999971, 0.866025404, 0.4330127031)), Plane(origin=(4291.082561, 496.4232481, 95.07750284), x=(0.8660254069, 0, 0.4999999947), y=(-0.2499999971, 0.866025404, 0.4330127031)), Plane(origin=(4273.202561, 496.4232481, 95.07750284), x=(0.8660254069, 0, 0.4999999947), y=(-0.2499999971, 0.866025404, 0.4330127031)), Plane(origin=(4334.842561, 468.7104352, 81.22109634), x=(0.8660254069, 0, 0.4999999947), y=(-0.2499999971, 0.866025404, 0.4330127031)), Plane(origin=(4316.962561, 468.7104352, 81.22109634), x=(0.8660254069, 0, 0.4999999947), y=(-0.2499999971, 0.866025404, 0.4330127031))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])
orient_2 = Orient(Geometry=geo_19, Source=pl_2, Target=move_3.Geometry)  # -> Geometry, Transform
orient_3 = Orient(Geometry=geo_20, Source=pl_2, Target=move_3.Geometry)  # -> Geometry, Transform
orient_4 = Orient(Geometry=merge, Source=pl_2, Target=move_3.Geometry)  # -> simplify(Geometry), Transform
toggle = BooleanToggle(True)
preview_2 = CustomPreview(
    Geometry=orient_2.Geometry,
    Material={diffuse=RGB(221, 160, 221), emission=RGB(66, 48, 66), shine=0.5, specular=RGB(255, 255, 255), transparency=0})
partition = PartitionList(List=orient_4.Geometry, Size=[30, 30])  # -> simplify(Chunks)
ur10e = GhPythonScript()  # -> robot
# ---------- ur10e: Python ----------
import os

import compas_fab
from compas.artists import Artist
from compas.geometry import Frame
from compas.robots import RobotModel
from compas.robots.resources import LocalPackageMeshLoader
from compas_fab.backends import AnalyticalInverseKinematics
from compas_fab.backends import OffsetWristKinematics
from compas_fab.backends.interfaces import ClientInterface
from compas_fab.robots import Robot
from compas_fab.robots import RobotSemantics


canvas = ghenv.Component.OnPingDocument()
#
urdf_folder = os.path.join(os.path.dirname(canvas.FilePath), '../dependencies/robots')
#urdf_file = os.path.join(urdf_folder, 'ur10e.urdf')

srdf_file = os.path.join(urdf_folder, 'ur10e.srdf')
#model = RobotModel.from_urdf_file(urdf_file)
#model = RobotModel.from_urdf_file('C:\Zac\GitHub\endless-wall-teamwork\dependencies\ur10.urdf')
urdf_file = compas_fab.get('universal_robot/ur_description/urdf/ur5.urdf')
model = RobotModel.from_urdf_file(urdf_file)

loader = LocalPackageMeshLoader(compas_fab.get('universal_robot'), 'ur_description')
model.load_geometry(loader)

semantics = RobotSemantics.from_srdf_file(srdf_file, model)

client = ClientInterface()
client.is_connected = True
client.inverse_kinematics = AnalyticalInverseKinematics(solver='ur10e')

robot = Robot(model, client=client, semantics=semantics)
robot.artist = Artist(model)
# ---------- end ur10e ----------
series_3 = Series(Start="3", Step=1, Count=Slider(9, range=0..10))
dom_2 = ConstructDomain(DomainStart="305", DomainEnd="334")
branch = TreeBranch(Tree=partition, Path=series_3, MaintainPaths=True)
range = Range(Domain=dom_2, Steps="29")
item_5 = ListItem(List=orient_4.Geometry, Index=range, Wrap=True)
panel_3 = Panel(orient_4.Geometry)

# ----
# Brick Wall_Version 1
number_slider_8 = Slider(140, range=0..1000)
cir = Circle(Plane=PlaneXY(0, 0, 0), Radius=number_slider_8)
series_4 = Series(Start=0, Step=Slider(15, range=0..100), Count=Slider(12, range=0..100))
multiplication_3 = Multiplication(A=number_slider_8, B=Slider(2, range=0..10))
Z_4 = UnitZ(Factor=series_4)
panel_4 = Panel(multiplication_3)
number_slider_9 = Slider(120, range=0..120)
move_4 = Move(Geometry=cir, Motion=Z_4)  # -> simplify(Geometry), Transform
dom_3 = ConstructDomain(DomainStart=0, DomainEnd=Slider(45, range=0..180))
range_2 = Range(Domain=dom_3, Steps=expr("x-1", "30"))
dispatch = Dispatch(List=move_4.Geometry, DispatchPattern=[True, False])  # -> ListA, ListB
graph = GraphMapper(range_2, x0=0, x1=45, y0=0, y1=45, container_name="Sine", Equation_px=[0, 0.5064998269], Equation_py=[0, 1])
division_2 = Division(A=number_slider_9, B="2")
hframes = HorizontalFrames(Curve=dispatch.ListA, Count=number_slider_9)  # -> Frames, Parameters
hframes_2 = HorizontalFrames(Curve=dispatch.ListB, Count=number_slider_9)  # -> Frames, Parameters
panel_5 = Panel(division_2)
dispatch_2 = Dispatch(List=hframes.Frames, DispatchPattern=[True, False])  # -> ListA, ListB
dispatch_3 = Dispatch(List=hframes_2.Frames, DispatchPattern=[True, False])  # -> ListA, ListB
pln = Plane(simplify(dispatch_3.ListB))  # disabled
prot = RotatePlane(Plane=pln, Angle=degrees(graph))  # -> simplify(Plane); disabled
neg_2 = Negative(Value=graph)  # disabled
path_mapper = PathMapper(prot, source="(A)", target="(A;+1)")  # disabled
panel_6 = Panel("12")  # disabled
series_5 = Series(Start=0, Step=panel_6, Count=panel_6)  # -> graft(Series); disabled
pt_2 = ConstructPoint(XCoordinate=0, YCoordinate=0, ZCoordinate=0)  # disabled
panel_7 = Panel("10")  # disabled
Z_5 = UnitZ(Factor=panel_7)  # disabled
number_slider_10 = Slider(186, range=0..1000)  # disabled
number_slider_11 = Slider(186, range=0..1000)  # disabled
panel_8 = Panel("9")  # disabled
X = UnitX(Factor=number_slider_11)  # disabled
Z_6 = UnitZ(Factor=panel_8)  # disabled
Y = UnitY(Factor=number_slider_10)  # disabled
addition_2 = Addition(B=X, C=Y)  # disabled
number_slider_12 = Slider(23, range=0..100)  # disabled
panel_9 = Panel("-90")  # disabled

# ----
# Circle Brick_Diagonal
pln_2 = Plane(simplify(dispatch_2.ListA))
branch_2 = TreeBranch(Tree=pln_2, Path="0", MaintainPaths=True)
deplane_4 = DeconstructPlane(Plane=branch_2)  # -> Origin, XAxis, YAxis, ZAxis
rot3d = Rotate3D(Geometry=branch_2, Angle=degrees("-15"), Center=deplane_4.Origin, Axis=deplane_4.YAxis)  # -> Geometry, Transform
orient_5 = Orient(Geometry=move.Geometry, Source=B, Target=rot3d.Geometry)  # -> Geometry, Transform

prot_2 = RotatePlane(Plane=pln_2, Angle=degrees(neg_2))  # -> simplify(Plane); disabled
merge_2 = Merge(Data1=prot_2, Data2=path_mapper)  # -> simplify(Result); disabled
rotate = Rotate(Geometry=merge_2, Angle=degrees(series_5), Plane=pt_2)  # -> Geometry, Transform; disabled
renumber = RenumberPaths(Data=rotate.Geometry)  # disabled
move_5 = Move(Geometry=renumber, Motion=Z_5)  # -> Geometry, Transform; disabled
tstat = TreeStatistics(Tree=move_5.Geometry)  # -> Paths, Length, Count; disabled
flatten = FlattenTree(Tree=move_5.Geometry, Path="{0}")  # disabled
orient_6 = Orient(Geometry=move.Geometry, Source=B, Target=flatten)  # -> Geometry, Transform
lng = ListLength(List=flatten)  # disabled
branch_3 = TreeBranch(Tree=move_5.Geometry, Path=number_slider_4, MaintainPaths=True)  # disabled
series_6 = Series(Start=0, Step=1, Count=lng)  # disabled
gradient = Gradient(
    LowerLimit=0,
    UpperLimit=lng,
    Parameter=series_6,
    stops=[0: RGB(234, 38, 0), 0.25: RGB(234, 126, 0), 0.5: RGB(254, 244, 84), 0.75: RGB(173, 203, 249), 1: RGB(75, 107, 169)])  # disabled
geo_21 = Geometry(flatten(branch_3))  # disabled
pln_3 = Plane(geo_21)  # disabled
move_6 = Move(Geometry=pln_3, Motion=addition_2)  # -> Geometry, Transform; disabled
preview_3 = CustomPreview(Geometry=flatten, Material=gradient)  # disabled
rotate_2 = Rotate(Geometry=move_6.Geometry, Angle=degrees(panel_9), Plane=move_6.Geometry)  # -> Geometry, Transform; disabled
points = PointList(Points=rotate_2.Geometry, Size=number_slider_12)  # disabled
plnaxis = PlaneAxis(P=rotate_2.Geometry, B=35)  # disabled

merge_3 = Merge(Data1=pln_2, Data2=pln)  # -> simplify(Result)
move_7 = Move(Geometry=orient_5.Geometry, Motion=Z_2)  # -> simplify(Geometry), Transform
rotate_3 = Rotate(Geometry=move_7.Geometry, Angle=degrees(series_2), Plane=PlaneXY(0, 0, 0))  # -> Geometry, Transform
colmm = CollisionManyMany(Colliders=rotate_3.Geometry)  # -> Collision, Indices
panel_10 = Panel(move_7.Geometry)

# ----
# Export Plane
rotate_4 = Rotate(Geometry=move_6.Geometry, Angle=0, Plane=move_6.Geometry)  # -> Geometry, Transform; disabled

item_6 = ListItem(List=rotate_2.Geometry, Index=Slider(15, range=0..100), Wrap=True)

# ----
# Brick Visualization
orient_7 = Orient(Geometry=move.Geometry, Source=B, Target=rotate_4.Geometry)  # -> Geometry, Transform; disabled

move_8 = Move(Geometry=item_6, Motion=Z_3)  # -> Geometry, Transform
panel_11 = Panel(move_8.Geometry)

# ---- group: FABRICATION WORKFLOW
python_4 = GhPythonScript(Code=file, ROBOT_IP="192.168.10.10", Fabricate=Button(), Debug_plane=move_8.Geometry)  # -> Out, Robot_base_plane, Script, Debug_plane

# ----
panel_12 = Panel(python_4.Out)

# ---- group: Get robot pose
python_5 = GhPythonScript(Code=file_2, Listen=Toggle(True), Robot_base_plane=python_4.Robot_base_plane)  # -> Out, Pose, Config

# ----
panel_13 = Panel(python_5.Out)
rad = Radians(Degrees=python_5.Config)
item_7 = ListItem(List=rad, Index=0, Wrap=True)  # -> Item, Item1, Item2, Item3, Item4, Item5
python_6 = GhPythonScript(x=item_7.Item, y=item_7.Item1, z=item_7.Item2, u=item_7.Item3, v=item_7.Item4, w=item_7.Item5)  # -> configuration
# ---------- python_6: Python ----------
import rhinoscriptsyntax as rs

from compas.robots import configuration
from compas_fab.robots import Configuration

configuration = Configuration.from_revolute_values([x,y,z,u,v,w])
# ---------- end python_6 ----------
robot_visualize = COMPASFABRobotVisualize(
    robot=ur10e,
    configuration=python_6,
    show_collision=toggle,
    show_frames=toggle,
    show_cm=Toggle(False),
    show_acm=Toggle(False))  # -> visual, collision, collision_meshes, attached_meshes, frames, base_frame, ee_frame; inputs show_visual: Boolean, show_collision: Boolean, show_frames: Boolean, show_base_frame: Boolean, show_end_effector_frame: Boolean, show_cm: Boolean, show_acm: Boolean
#   port group: The planning group used for end-effector and base visualization.
#   port configuration: The robot's full configuration.
#   port show_visual: Whether or not to show the robot's visual meshes.
#   port show_collision: Whether or not to show the robot's collision meshes.
#   port show_frames: Whether or not to show the robot's joint frames.
#   port show_base_frame: Whether or not to show the robot's base frame.
#   port show_end_effector_frame: Whether or not to show the robot's end-effector frame.
#   port show_cm: Whether or not to show the collision meshes (if any).
#   port show_acm: Whether or not to show the attached collision meshes (if any).
#   port visual: Rhino meshes of the robot's visual geometry (if any).
#   port collision: Rhino meshes of the robot's collision geometry (if any).
#   port collision_meshes: Rhino meshes of the scene's collision meshes (if any).
#   port attached_meshes: Rhino meshes of the scene's attached collision meshes (if any).
#   port frames: The robot's joint frames as Rhino planes (if any).
#   port base_frame: The robot's base frame as a Rhino plane (if any).
#   port ee_frame: The robot's end-effector frame as a Rhino plane (if any).
# ---------- robot_visualize: Python ----------
"""
Visualizes the robot.

COMPAS FAB v0.27.0
"""
from compas.artists import Artist
from compas.geometry import Frame
from compas.geometry import Transformation
from compas_fab.robots import PlanningScene
from ghpythonlib.componentbase import executingcomponent as component
import Rhino.Geometry as rg


class RobotVisualize(component):
    def RunScript(
        self,
        robot,
        group,
        configuration,
        show_visual,
        show_collision,
        show_frames,
        show_base_frame,
        show_end_effector_frame,
        show_cm,
        show_acm,
    ):

        visual = None
        collision = None
        collision_meshes = None
        attached_meshes = None
        frames = None
        base_frame = None
        ee_frame = None

        if robot:
            show_visual = True if show_visual is None else show_visual
            show_cm = True if show_cm is None else show_cm
            show_acm = True if show_acm is None else show_acm
            configuration = configuration or robot.zero_configuration()

            robot.update(configuration, visual=show_visual, collision=show_collision)
            compas_frames = robot.transformed_frames(configuration, group)

            if show_visual:
                visual = robot.artist.draw_visual()

            if show_collision:
                collision = robot.artist.draw_collision()

            if show_base_frame:
                base_compas_frame = compas_frames[0]
                artist = Artist(base_compas_frame)
                base_frame = artist.draw()

            if show_end_effector_frame:
                ee_compas_frame = robot.forward_kinematics(
                    configuration, group, options=dict(solver="model")
                )
                artist = Artist(ee_compas_frame)
                ee_frame = artist.draw()

            if show_frames:
                frames = []
                for compas_frame in compas_frames[1:]:
                    artist = Artist(compas_frame)
                    frame = artist.draw()
                    frames.append(frame)

            if show_cm or show_acm:
                scene = PlanningScene(robot)
                scene = robot.client.get_planning_scene()

                collision_meshes = []
                attached_meshes = []

                if show_cm:
                    for co in scene.world.collision_objects:
                        header = co.header
                        frame_id = header.frame_id
                        cms = co.to_collision_meshes()

                        for cm in cms:
                            if cm.frame != Frame.worldXY():
                                t = Transformation.from_frame(cm.frame)
                                mesh = cm.mesh.transformed(t)
                            else:
                                mesh = cm.mesh

                            collision_meshes.append(Artist(mesh).draw())

                if show_acm:
                    for aco in scene.robot_state.attached_collision_objects:
                        for acm in aco.to_attached_collision_meshes():
                            frame_id = aco.object["header"]["frame_id"]
                            frame = robot.forward_kinematics(
                                configuration, options=dict(link=frame_id)
                            )
                            t = Transformation.from_frame(frame)

                            # Local CM frame
                            if (
                                acm.collision_mesh.frame
                                and acm.collision_mesh.frame != Frame.worldXY()
                            ):
                                t = t * Transformation.from_frame(
                                    acm.collision_mesh.frame
                                )

                            mesh = acm.collision_mesh.mesh.transformed(t)

                            attached_meshes.append(Artist(mesh).draw())
#        for v in visual:
#            v.Transform(rg.Transform.Scale(rg.Point3d(0,0,0),10))
        return (
            visual,
            collision,
            collision_meshes,
            attached_meshes,
            frames,
            base_frame,
            ee_frame,
        )
# ---------- end robot_visualize ----------
scale = Scale(Geometry=robot_visualize.visual, Center=Point(0, 0, 0), Factor=1000)  # -> Geometry, Transform
geo_22 = Geometry(scale.Geometry)

Y_2 = UnitY(Factor=1)  # disabled
panel_14 = Panel("90")  # disabled
rot3d_2 = Rotate3D(Geometry=B, Angle=degrees(panel_14), Center=Point(0, 0, 0), Axis=Y_2)  # -> Geometry, Transform; disabled
panel_15 = Panel("10")  # disabled
panel_16 = Panel("15")  # disabled
panel_17 = Panel("32")  # disabled
box_2 = CenterBox(Base=rot3d_2.Geometry, X=expr("x/2", panel_17), Y=expr("x/2", panel_16), Z=expr("x/2", panel_15))  # disabled
debrep_2 = DeconstructBrep(Brep=box)  # -> Faces, Edges, Vertices; disabled
debrep_3 = DeconstructBrep(Brep=box_2)  # -> Faces, Edges, Vertices; disabled
panel_18 = Panel("1")  # disabled
panel_19 = Panel("1")  # disabled
item_8 = ListItem(List=debrep_2.Vertices, Index=panel_19, Wrap=True)  # disabled
item_9 = ListItem(List=debrep_3.Vertices, Index=panel_18, Wrap=True)  # disabled
vec2pt_4 = Vector2Pt(PointA=item_9, PointB=item_8, Unitize=False)  # -> Vector, Length; disabled
move_9 = Move(Geometry=rot3d_2.Geometry, Motion=vec2pt_4.Vector)  # -> Geometry, Transform; disabled
merge_4 = Merge(Data1=B, Data2=move_9.Geometry)  # disabled
Y_3 = UnitY(Factor=1)  # disabled
panel_20 = Panel("45")  # disabled
rot3d_3 = Rotate3D(Geometry=merge_4, Angle=degrees(panel_20), Center=Point(0, 0, 0), Axis=Y_3)  # -> simplify(Geometry), Transform; disabled
panel_21 = Panel("45.25")  # disabled
series_7 = Series(Start=0, Step=panel_21, Count=number_slider_2)  # disabled
renumber_2 = RenumberPaths(Data=rot3d_3.Geometry)  # disabled
panel_22 = Panel("14.14")  # disabled
X_2 = UnitX(Factor=series_7)  # disabled
series_8 = Series(Start=0, Step=panel_22, Count=number_slider_3)  # -> graft(Series); disabled
move_10 = Move(Geometry=renumber_2, Motion=X_2)  # -> Geometry, Transform; disabled
Z_7 = UnitZ(Factor=series_8)  # disabled
flip = FlipMatrix(Data=move_10.Geometry)  # -> reverse(simplify(Data)); disabled
panel_23 = Panel("1")  # disabled
item_10 = ListItem(List=flip, Index=panel_23, Wrap=True)  # disabled
item_11 = ListItem(List=flip, Index=0, Wrap=True)  # disabled
deplane_5 = DeconstructPlane(Plane=item_11)  # -> Origin, XAxis, YAxis, ZAxis; disabled
neg_3 = Negative(Value=deplane_5.XAxis)  # disabled
pl_3 = ConstructPlane(Origin=deplane_5.Origin, XAxis=neg_3, YAxis=deplane_5.YAxis)  # disabled
merge_5 = Merge(Data1=pl_3, Data2=item_10)  # disabled
flatten_2 = FlattenTree(Tree=merge_5, Path="{0}")  # disabled
move_11 = Move(Geometry=flatten_2, Motion=Z_7)  # -> flatten(Geometry), Transform; disabled
plnaxis_2 = PlaneAxis(P=move_11.Geometry, B=35)  # disabled
number_slider_13 = Slider(9, range=0..100)  # disabled
points_2 = PointList(Points=move_11.Geometry, Size=number_slider_13)  # disabled
series_9 = Series(Start=0, Step=1, Count=number_slider_7)  # disabled

deplane_6 = DeconstructPlane(Plane=move_11.Geometry)  # -> Origin, XAxis, YAxis, ZAxis; disabled
perlin = PerlinNoise(Values=deplane_6.Origin, Time=number_slider_5, Scale=number_slider_6)  # disabled
bnd = Bounds(Numbers=perlin)  # disabled
remap = RemapNumbers(Value=perlin, Source=bnd, Target=dom)  # -> Mapped, Clipped; disabled
Y_4 = UnitY(Factor=remap.Mapped)  # disabled
move_12 = Move(Geometry=move_11.Geometry, Motion=Y_4)  # -> Geometry, Transform; disabled

panel_24 = Panel("32")  # disabled
panel_25 = Panel("15")  # disabled
panel_26 = Panel("10")  # disabled
box_3 = CenterBox(Base=move_12.Geometry, X=expr("x/2", panel_24), Y=expr("x/2", panel_25), Z=expr("x/2", panel_26))  # disabled

lng_2 = ListLength(List=box_3)  # disabled

item_12 = ListItem(List=box_3, Index=series_9, Wrap=True)  # disabled

first_last = FirstLast(List=item_12)  # -> FirstValue, LastValue; disabled
preview_4 = CustomPreview(Geometry=box_3, Material=swatch)  # disabled

# ==== cluster PlaneAxis: show plane X Y Z axis.
P = ClusterInput()
B = ClusterInput()
deplane = DeconstructPlane(Plane=graft(P))  # -> Origin, XAxis, YAxis, ZAxis
multiplication = Multiplication(A=[deplane.XAxis, deplane.YAxis, deplane.ZAxis], B=B)
vdisex = VectorDisplayEx(
    Point=deplane.Origin,
    Vector=multiplication,
    Colour=[ColourSwatch(SwatchColor=RGB(235, 52, 52)), ColourSwatch(SwatchColor=RGB(90, 207, 48)), ColourSwatch(SwatchColor=RGB(54, 126, 227))],
    Width=2)
