# Grasshopper definition FormFinder_CJ.ghx (Grasshopper 1.0.7)

# ----
# Import Location from EPW File
panel = Panel("https://climate.onebuilding.org/WMO_Region_6_Europe/CHE_Switzerland/ZH_Zurich/CHE_ZH_Zurich.Affoltern.066640_TMYx.2007-2021.zip")
downloadepw = LBDownloadWeather(weather_URL=panel)  # -> epw_file, stat_file, ddy_file; plug-in component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
importloc = LBImportLocation(epw_file=downloadepw.epw_file)  # -> location; plug-in component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

number_slider = Slider(10, range=0..24)
number_slider_2 = Slider(19, range=1..31)
number_slider_3 = Slider(5, range=1..12)

# ----
# Analysis Period for
# Summer Solstice
panel_2 = Panel("4")
panel_3 = Panel("6")
panel_4 = Panel("21")
analysisperiod = LBAnalysisPeriod(
    start_month=number_slider_3,
    start_day=number_slider_2,
    start_hour=number_slider,
    end_month=number_slider_3,
    end_day=number_slider_2,
    end_hour=number_slider,
    timestep=panel_2)  # -> period, hoys, dates; plug-in component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

importepw = LBImportEPW(epw_file=downloadepw.epw_file)  # -> location, dry_bulb_temperature, dew_point_temperature, relative_humidity, wind_speed, wind_direction, direct_normal_rad, diffuse_horizontal_rad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; plug-in component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
panel_5 = Panel(importepw.wind_direction)

# ----
# Create Sunpath
panel_6 = Panel("20")
sunpath = LBSunPath(north=panel_6, location=importloc, hoys=analysisperiod.hoys, scale=1)  # -> report, vectors, altitudes, azimuths, hoys, sun_pts, analemma, daily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; plug-in component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

number_slider_4 = Slider(0, range=0..100)
windrose = LBWindRose(north=panel_6, data=importepw.wind_speed, wind_direction=importepw.wind_direction)  # -> report, mesh, compass, orient_line, freq_line, windrose_line, legend, title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; plug-in component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
pt = ConstructPoint(XCoordinate=number_slider_4, YCoordinate=number_slider_4, ZCoordinate=number_slider_4)

# ---- group: Run Me!
toggle = BooleanToggle(True)

# ----
# Run Direct Sun Study
geo = Geometry(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)
geo_2 = Geometry(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)
directsunhours = LBDirectSunHours(
    vectors=flatten(sunpath.vectors),
    timestep=panel_2,
    geometry=flatten(geo),
    context=flatten(geo_2),
    grid_size="5",
    offset_dist="0.1",
    run=toggle)  # -> report, points, results, mesh, legend, title, int_mtx; plug-in component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

boundary = BoundarySurfaces(Edges=windrose.windrose_line)
item = ListItem(List=sunpath.vectors, Index=0, Wrap=True)
join = BrepJoin(Breps=boundary)  # -> Breps, Closed
edges = BrepEdges(Brep=join.Breps)  # -> Naked, Interior, NonManifold
devec = DeconstructVector(Vector=item)  # -> XComponent, YComponent, ZComponent
dom = ConstructDomain(DomainStart=0, DomainEnd=Slider(2, range=1..3))
cir = Circle(Plane=pt, Radius=Slider(33, range=0..100))
join_2 = JoinCurves(Curves=edges.Naked, Preserve=False)
remap = RemapNumbers(Value=devec.ZComponent, Source=Domain(0, 1), Target=dom)  # -> Mapped, Clipped
vec = VectorXYZ(XComponent=devec.XComponent, YComponent=devec.YComponent, ZComponent=remap.Mapped)  # -> Vector, Length
neg = Negative(Value=vec.Vector)
scale = Scale(Geometry=join_2, Center=Point(0, 0, 0), Factor=Slider(0.005, range=0..0.01))  # -> Geometry, Transform
smoothpline = SmoothPolyline(Polyline=scale.Geometry, Strength=Slider(1, range=0..1), Times=Slider(10, range=0..10))
multiplication = Multiplication(A=neg, B=Slider(200, range=0..1000))
line = LineSDL(Start=pt, Direction=neg, Length=multiplication)
move = Move(Geometry=smoothpline, Motion=multiplication)  # -> Geometry, Transform
area = Area(Geometry=move.Geometry)  # -> Area, Centroid
scale_2 = Scale(Geometry=move.Geometry, Center=area.Centroid, Factor=Slider(0.8, range=0..10))  # -> Geometry, Transform
loft = Loft(
    Curves=[scale_2.Geometry, scale.Geometry],
    Options={Adjust=False, Closed=False, LoftEnds=0, LoftSimp=0, LoftType=0, Rebuild=10, Refit=0.01})
angle = Slider(45, range=-90..90)
angle_2 = Slider(-1, range=-90..90)
python = GhPythonScript(crv=scale_2.Geometry, layer_num=Slider(2, range=0..100), bricks_angle=angle)  # -> out, a, pt_bricks, crvs, bricks; inputs crv: Curve, srf: Surface, layer_num: Int32, bricks_angle: Int32
# ---------- python: Python ----------
import rhinoscriptsyntax as rs
import Rhino.Geometry as rg
import Rhino
import math
import copy
import System
import ghpythonlib.treehelpers as th

tolerance = Rhino.RhinoDoc.ActiveDoc.ModelAbsoluteTolerance

length = 30
width = 15
height = 10



class Brickwall(object):
    
    """
    this is a class to create a wall from a input curve and get the origin for its bricks
    
    """
    
    # this varible was defined outside of the class
    # we need to declare it as global so it will be shared by all instances of the class
    global height
    
    
    # this method gets calles as soon as the object of a class is initiated
    # here we define instance variables = attributes of the object
    def __init__(self, crv = None, srf = None , layer_cnt = None):
        
        self.layer_cnt = layer_cnt
        self.brick_cnt = None
        
        self.crv = crv
        self.srf = srf
        
        self.crvs = []
        self.bricks = []
        
        if self.crv is not None:
            self.wall_from_curve(self.crv)
        elif self.srf is not None:
            self.wall_from_surface(srf)
        
    def get_layers(self, curve):
        
        crvs = []
        for i in range(self.layer_cnt):
            T = rg.Transform.Translation(rg.Vector3d(0,0,i*height))
            c = copy.copy(curve)
            c.Transform(T)
            crvs.append(c)
        return crvs
    
    def get_bricks(self):
        for i, c in enumerate(self.crvs):
            self.brick_cnt = math.floor(c.GetLength()/(length+5))
            params = c.DivideByCount(self.brick_cnt*2,True)
            pts = []
            tngts = []
            # list comprehension
            bricks = [Brick(c.PointAt(p),c.TangentAt(p)) for p in params[i%2::2]]  #Creating objects of type Brick class
            self.bricks.append(bricks)
    
    def create_contours(self, srf, height):
        bounding_box = rg.Brep.GetBoundingBox(srf, rg.Plane.WorldXY)
        num_layers =  int(math.ceil(bounding_box.Max.Z/height))
        inter_crvs = []
        for i in range(num_layers):
            origin = rg.Point3d(0,0,i*height)
            brep = srf.ToBrep()
            plane = rg.Plane(origin, rg.Vector3d.XAxis, rg.Vector3d.YAxis)
            
            intersection_event = rg.Intersect.Intersection.BrepPlane(brep,plane,tolerance)
            inter_crvs.append(intersection_event[1][0])
        return inter_crvs
    
    def wall_from_curve(self, curve):
        self.crvs = self.get_layers(curve)
        self.get_bricks()
    
    def wall_from_surface(self,srf):
        self.crvs = self.create_contours(srf, height)
        self.get_bricks()


class Brick(object):
    
    """
    this is a class to make a brick
    """
    
    global length
    global width
    global height

    # this method gets calles as soon as the object of a class is initiated
    # here we define instance variables = attributes of the object
    def __init__(self, origin, vec):
        
        
        self.origin = origin 
        self.vec = vec # point's tangent vector

        
        self.pts = self.brick_pts()
        
        self.start_plane = self.get_start_plane()
        self.target_plane = self.get_target_plane()
        
        self.mesh = self.brick_mesh()
        self.neighbors= []
        self.color = []
        
        
        
    # this method will be called in the __init__ function
    # it returns a list of 8 points of the bounding box 
    def brick_pts(self):
        
        pt_0 = rg.Point3d(self.origin.X-length/2, self.origin.Y-width/2, self.origin.Z)
        pt_1 = rg.Point3d(pt_0.X + length, pt_0.Y, self.origin.Z)
        pt_2 = rg.Point3d(pt_1.X, pt_1.Y + width, self.origin.Z)
        pt_3 = rg.Point3d(pt_2.X - length, pt_2.Y, self.origin.Z)

        pt_4 = rg.Point3d(pt_0.X, pt_0.Y, pt_0.Z + height)
        pt_5 = rg.Point3d(pt_1.X, pt_1.Y, pt_1.Z + height)
        pt_6 = rg.Point3d(pt_2.X, pt_2.Y, pt_2.Z + height)
        pt_7 = rg.Point3d(pt_3.X, pt_3.Y, pt_3.Z + height)

        b_pts = [pt_0, pt_1, pt_2, pt_3, pt_4, pt_5, pt_6, pt_7]

        return b_pts
    
    # this method is called in the __init__ function
    # it returns the start_plane of the brick accodring to boolean input
    def get_start_plane(self):
        
        yvec = rg.Vector3d.CrossProduct(rg.Vector3d(0,0,1), self.vec)
        start_plane = rg.Plane(self.origin, self.vec, yvec)
            
        return start_plane
    
    # this method is called in the __init__ function
    # it returns the rotated start plabe plane according to input value 
    def get_target_plane(self):
        c = copy.copy(self.start_plane)
        c.Rotate(math.radians(bricks_angle), rg.Vector3d.ZAxis, self.origin)
        return c
    
    # this method is called in the __init__ funciton
    # it creates the mesh from 8 points, transforms its plane and returns the mesh 
    def brick_mesh(self):
        br = rg.Mesh.CreateFromBox(self.pts,1,1,1)
        P = rg.Plane(self.origin, rg.Vector3d.XAxis, rg.Vector3d.YAxis)
        T1 = rg.Transform.PlaneToPlane(P, self.start_plane)
        T2 = rg.Transform.PlaneToPlane(self.start_plane, self.target_plane)
        br.Transform(T1)
        br.Transform(T2)
        
        return br

# calling the object
wall = Brickwall(crv = crv, srf = srf ,layer_cnt = layer_num)

bricks = [brick.brick_mesh() for brick_list in wall.bricks for brick in brick_list]
# ---------- end python ----------
rad = Radians(Degrees=Slider(10, range=0..30))
python_2 = GhPythonScript(brep=loft, layer_num=Slider(2, range=0..100), bricks_angle=angle_2, angle=rad)  # -> out, a, pt_bricks, crvs, bricks, plane; inputs crv: Curve, srf: Surface, brep: Brep, layer_num: Int32, bricks_angle: Int32
# ---------- python_2: Python ----------
import rhinoscriptsyntax as rs
import Rhino.Geometry as rg
import Rhino
import math
import copy
import System
import ghpythonlib.treehelpers as th

tolerance = Rhino.RhinoDoc.ActiveDoc.ModelAbsoluteTolerance

length = 30
width = 15
height = 10



class Brickwall(object):
    
    """
    this is a class to create a wall from a input curve and get the origin for its bricks
    
    """
    
    # this varible was defined outside of the class
    # we need to declare it as global so it will be shared by all instances of the class
    global height
    
    
    # this method gets calles as soon as the object of a class is initiated
    # here we define instance variables = attributes of the object
    def __init__(self, crv = None, srf = None , brep = None, layer_cnt = None):
        
        self.layer_cnt = layer_cnt
        self.brick_cnt = None
        
        self.crv = crv
        self.srf = srf
        self.brep = brep
        self.crvs = []
        self.bricks = []
        
        if self.crv is not None:
            self.wall_from_curve(self.crv)
        elif self.srf is not None:
            self.wall_from_surface(srf)
        else:
            self.wall_from_brep(brep)
        
    def get_layers(self, curve):
        
        crvs = []
        for i in range(self.layer_cnt):
            T = rg.Transform.Translation(rg.Vector3d(0,0,i*height))
            c = copy.copy(curve)
            c.Transform(T)
            crvs.append(c)
        return crvs
    
    def get_bricks(self):
        for i, c in enumerate(self.crvs):
            self.brick_cnt = math.floor(c.GetLength()/(length+5))
            params = c.DivideByCount(self.brick_cnt*2,True)
            pts = []
            tngts = []
            # list comprehension
            bricks = [Brick(c.PointAt(p),c.TangentAt(p)) for p in params[i%2::2]]  #Creating objects of type Brick class
            self.bricks.append(bricks)
    
    def create_contours(self, srf, height):
        bounding_box = rg.Brep.GetBoundingBox(srf, rg.Plane.WorldXY)
        num_layers =  int(math.ceil(bounding_box.Max.Z/height))
        inter_crvs = []
        for i in range(num_layers):
            origin = rg.Point3d(0,0,i*height)
            if type(srf) != type(rg.Brep()):
                brep = srf.ToBrep()
            else:
                brep = self.brep
            plane = rg.Plane(origin, rg.Vector3d.XAxis, rg.Vector3d.YAxis)
            rg.Plane.Rotate(plane, angle,rg.Vector3d.XAxis, plane.Origin)
            plane.Transform(rg.Transform.Translation(rg.Vector3d(0,0,-0.1)))
            intersection_event = rg.Intersect.Intersection.BrepPlane(brep,plane,tolerance)
            inter_crvs.append(intersection_event[1][0])
        return inter_crvs
    
    def wall_from_curve(self, curve):
        self.crvs = self.get_layers(curve)
        self.get_bricks()
    
    def wall_from_surface(self,srf):
        self.crvs = self.create_contours(srf, height)
        self.get_bricks()
        
    def wall_from_brep(self,brep):
        self.crvs = self.create_contours(brep, height)
        self.get_bricks()


class Brick(object):
    
    """
    this is a class to make a brick
    """
    
    global length
    global width
    global height

    # this method gets calles as soon as the object of a class is initiated
    # here we define instance variables = attributes of the object
    def __init__(self, origin, vec):
        
        
        self.origin = origin 
        self.vec = vec # point's tangent vector

        
        self.pts = self.brick_pts()
        
        self.start_plane = self.get_start_plane()
        self.target_plane = self.get_target_plane()
        
        self.mesh = self.brick_mesh()
        self.neighbors= []
        self.color = []
        
        
        
    # this method will be called in the __init__ function
    # it returns a list of 8 points of the bounding box 
    def brick_pts(self):
        
        pt_0 = rg.Point3d(self.origin.X-length/2, self.origin.Y-width/2, self.origin.Z)
        pt_1 = rg.Point3d(pt_0.X + length, pt_0.Y, self.origin.Z)
        pt_2 = rg.Point3d(pt_1.X, pt_1.Y + width, self.origin.Z)
        pt_3 = rg.Point3d(pt_2.X - length, pt_2.Y, self.origin.Z)

        pt_4 = rg.Point3d(pt_0.X, pt_0.Y, pt_0.Z + height)
        pt_5 = rg.Point3d(pt_1.X, pt_1.Y, pt_1.Z + height)
        pt_6 = rg.Point3d(pt_2.X, pt_2.Y, pt_2.Z + height)
        pt_7 = rg.Point3d(pt_3.X, pt_3.Y, pt_3.Z + height)

        b_pts = [pt_0, pt_1, pt_2, pt_3, pt_4, pt_5, pt_6, pt_7]

        return b_pts
    
    # this method is called in the __init__ function
    # it returns the start_plane of the brick accodring to boolean input
    def get_start_plane(self):
        
        yvec = rg.Vector3d.CrossProduct(rg.Vector3d(0,0,1), self.vec)
        start_plane = rg.Plane(self.origin, self.vec, yvec)
            
        return start_plane
    
    # this method is called in the __init__ function
    # it returns the rotated start plabe plane according to input value 
    def get_target_plane(self):
        c = copy.copy(self.start_plane)
        c.Rotate(math.radians(bricks_angle), rg.Vector3d.ZAxis, self.origin)
        return c
    
    # this method is called in the __init__ funciton
    # it creates the mesh from 8 points, transforms its plane and returns the mesh 
    def brick_mesh(self):
        br = rg.Mesh.CreateFromBox(self.pts,1,1,1)
        P = rg.Plane(self.origin, rg.Vector3d.XAxis, rg.Vector3d.YAxis)
        T1 = rg.Transform.PlaneToPlane(P, self.start_plane)
        T2 = rg.Transform.PlaneToPlane(self.start_plane, self.target_plane)
        br.Transform(T1)
        br.Transform(T2)
        
        return br

# calling the object
wall = Brickwall(crv = crv, srf = srf ,brep = brep, layer_cnt = layer_num)
#print (wall)
bricks = [brick.brick_mesh() for brick_list in wall.bricks for brick in brick_list]
# ---------- end python_2 ----------
pt_2 = Point(flatten(python.pt_bricks))
crv = Curve(python.crvs)
mesh = Mesh(python.bricks)
preview = CustomPreview(Geometry=mesh, Material=ColourSwatch(SwatchColor=RGB(99, 107, 255)))
mesh_2 = Mesh(python_2.bricks)
pt_3 = Point(flatten(python_2.pt_bricks))
crv_2 = Curve(python_2.crvs)
preview_2 = CustomPreview(Geometry=mesh_2, Material=ColourSwatch(SwatchColor=RGB(99, 107, 255)))
