# Grasshopper definition simulation.gh (Grasshopper 1.0.7)

ghpython_script = GhPythonScript()  # -> Out, OutTemp
_0_to_1_00 = Slider(0, range=0..1)
_1_to_100 = Slider(0, range=0..100)
c_script = CSharpScript()  # -> Out, A
linear_dimension = LinearDimension(Text="{0:0.00}", Size=1)
panel = Panel("C:\Zac\GitHub\endless-wall-teamwork\simulation\fabrication_workflow.py")

# ---- group: bricks_for_displaying
data = Data([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])

# ---- group: picking_plans
data_2 = Data([Plane(origin=(4326.842561, 496.4232481, 95.07750284), x=(0.8660254069, 0, 0.4999999947), y=(-0.2499999971, 0.866025404, 0.4330127031)), Plane(origin=(4308.962561, 496.4232481, 95.07750284), x=(0.8660254069, 0, 0.4999999947), y=(-0.2499999971, 0.866025404, 0.4330127031)), Plane(origin=(4291.082561, 496.4232481, 95.07750284), x=(0.8660254069, 0, 0.4999999947), y=(-0.2499999971, 0.866025404, 0.4330127031)), Plane(origin=(4273.202561, 496.4232481, 95.07750284), x=(0.8660254069, 0, 0.4999999947), y=(-0.2499999971, 0.866025404, 0.4330127031)), Plane(origin=(4334.842561, 468.7104352, 81.22109634), x=(0.8660254069, 0, 0.4999999947), y=(-0.2499999971, 0.866025404, 0.4330127031)), Plane(origin=(4316.962561, 468.7104352, 81.22109634), x=(0.8660254069, 0, 0.4999999947), y=(-0.2499999971, 0.866025404, 0.4330127031))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])

# ----
pln = Plane(Plane(origin=(414.21, -714.25, -564.7), x=(0.842762809, 0.1355324124, 0.5209431955), y=(0.0946023538, 0.9154268812, -0.3912084097)))
item = ListItem(List=data_2, Index=0, Wrap=True)
orient = Orient(Geometry=data_2, Source=item, Target=pln)  # -> Geometry, Transform
read_file = ReadFile(File=panel, PerLineParse=False)

# ---- group: FABRICATION WORKFLOW
python = GhPythonScript(Code=read_file, Picking_plans=orient.Geometry, Fabricate=Button())  # -> Out, Script, Vis_planes, Pick_up_plane, Pick_station
pln_2 = Plane(python.Vis_planes)
panel_2 = Panel(python.Out)

# ---- group: backup
geometry = Geometry([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])  # disabled
geometry_2 = Geometry([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])  # disabled
geometry_3 = Geometry([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])  # disabled
geometry_4 = Geometry([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])  # disabled
geometry_5 = Geometry([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])  # disabled
geometry_6 = Geometry([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])  # disabled
geometry_7 = Geometry([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])  # disabled
geometry_8 = Geometry([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])  # disabled
geometry_9 = Geometry([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])  # disabled
geometry_10 = Geometry([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])  # disabled
geometry_11 = Geometry([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])  # disabled
merge = Merge(
    Data1=geometry,
    Data2=geometry_2,
    Data3=geometry_3,
    Data4=geometry_4,
    Data5=geometry_5,
    Data6=geometry_6,
    Data7=geometry_7,
    Data8=geometry_8,
    Data9=geometry_9,
    Data10=geometry_10,
    Data11=geometry_11)  # -> flatten(Result); disabled

colour_swatch = ColourSwatch(SwatchColor=RGBA(232, 0, 0, 249))  # disabled
custom_preview = CustomPreview(Geometry=merge, Material=colour_swatch)  # disabled

# ----
pln_3 = Plane(python.Pick_up_plane)
pln_4 = Plane(python.Pick_station)
panel_3 = Panel(pln_4)
