# Grasshopper definition 1_4 Bricks Fabrication Test.gh (Grasshopper 1.0.7)

brep = Brep([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])  # disabled
debrep = DeconstructBrep(Brep=brep)  # -> Faces, Edges, Vertices; disabled
pln = Plane([Plane(origin=(161.6229887, 28.38024757, 16.1822729), x=(0, 1, 0), y=(-0.9659258263, 0, -0.2588190451)), Plane(origin=(163.6213372, 9.308530362, 16.71772876), x=(0, 1, 0), y=(-0.9659258263, 0, -0.2588190451)), Plane(origin=(133.1195796, 104.336709, 18.89204565), x=(0, 1, 0), y=(-0.9659258263, 0, -0.2588190451)), Plane(origin=(57.83938033, 163.436053, 19.42077705), x=(0, 1, 0), y=(-0.9659258263, 0, -0.2588190451)), Plane(origin=(98.92782482, 137.8738682, 20.08315438), x=(0, 1, 0), y=(-0.9659258263, 0, -0.2588190451)), Plane(origin=(147.1415176, 81.21824794, 22.64921261), x=(0, 1, 0), y=(-0.9659258263, 0, -0.2588190451))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])
# 1_4 Bricks Fabrication Test
brep_2 = Brep([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])
panel = Panel("5")  # disabled
item = ListItem(List=debrep.Faces, Index=panel, Wrap=True)  # -> simplify(Item); disabled
number_slider = Slider(2, range=0..11)  # disabled
number_slider_2 = Slider(3, range=0..11)  # disabled
debrep_2 = DeconstructBrep(Brep=item)  # -> Faces, Edges, Vertices; disabled
area = Area(Geometry=item)  # -> Area, Centroid; disabled
item_2 = ListItem(List=debrep_2.Edges, Index=number_slider, Wrap=True)  # disabled
item_3 = ListItem(List=debrep_2.Edges, Index=number_slider_2, Wrap=True)  # disabled
number_slider_3 = Slider(55, range=1..55)  # disabled
curvepoint = PointOnCurve(item_2, parameter=0.5)  # disabled
curvepoint_2 = PointOnCurve(item_3, parameter=0.5)  # disabled
pl_3pt = Plane3Pt(PointA=area.Centroid, PointB=curvepoint, PointC=curvepoint_2)  # -> flatten(Plane); disabled
series = Series(Start=0, Step=1, Count=number_slider_3)  # disabled
rev = ReverseList(List=pl_3pt)  # disabled
item_4 = ListItem(List=rev, Index=series, Wrap=True)  # disabled
